# Grasshopper definition Terrain & Walls & Roofs.gh (Grasshopper 1.0.7)
# plug-ins: Pufferfish, Weaverbird, Speckle 2, Kangaroo2 Components, Human, MetaHopper, Rhino.Inside for Autodesk Revit, MeshEdit Components, ShapeDiverForGrasshopper, LunchBox

sddp = ShapeDiverDocumentPayload({AbsoluteTolerance=0, AngleTolerance=0, DistanceDisplayPrecision=0, GltfVersion="Gltf2", GrasshopperVersion="1.0.0007", InputGroups="{}", OutputGroups="{}", RelativeTolerance=0, RhinoVersion="7.36.23346.16351", UnitSystem=0, VersionCreated="1.14.0.0", VersionSaved="1.14.0.0"})

# ----
# TURN OFF
# BEFORE
# OPENING
# RHINO
# FILE
# UNITS & FLOORS (Sorted by Levels)
toggle = GroupToggle(ToggleActive=True, ToggleVisible=False)  # disabled

# ---- group: New Site Mesh (A4)
mesh = Mesh(<mesh referenced from the Rhino model>)

# ---- group: Projection Plane Point
pt = Point(<point referenced from the Rhino model>)

# ---- group: UNITS (LATEST LOCATION)
brep = Brep([<brep referenced from the Rhino model> x74])

# ---- group: Units Internalised LATEST LOCATION
brep_2 = Brep([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])

# ----
volume = Volume(Geometry=brep_2)  # -> Volume, Centroid
# 03
# 02
# 01
# 00
pdecon = Deconstruct(Point=volume.Centroid)  # -> XComponent, YComponent, ZComponent
cset = CreateSet(List=pdecon.ZComponent)  # -> Set, Map
sort = SortList(Keys=cset.Set)  # -> Keys, ValuesA
mindex = MemberIndex(Set=pdecon.ZComponent, Member=graft(sort.Keys))  # -> Index, Count

# ---- group: Units Grouped by Level
item = ListItem(List=brep_2, Index=mindex.Index, Wrap=True)

# ----
# Contour Lines (Projected on plane above)
xy = XYPlane(Origin=pt)
project = Project(Geometry=flatten(item), Plane=xy)  # -> Geometry, Transform
debrep = DeconstructBrep(Brep=project.Geometry)  # -> Faces, flatten(Edges), Vertices
len = Length(Curve=debrep.Edges)
larger = LargerThan(FirstNumber=len, SecondNumber="0.001")  # -> LargerThan, OrEqualTo
cull = CullPattern(List=debrep.Edges, CullPattern=larger.LargerThan)
panel = Panel("""0
1""")
cull_2 = CullPattern(List=cull, CullPattern=panel)
join = JoinCurves(Curves=cull_2, Preserve=False)
runion = RegionUnion(Curves=flatten(join))
item_2 = ListItem(List=runion, Index=0, Wrap=True)  # -> Item, Item1
number_slider = Slider(0.49, range=0..20)
disc = Discontinuity(Curve=item_2.Item, Level=1)  # -> Points, Parameters
nurbs = NurbsCurve(Vertices=disc.Points, Degree=3, Periodic=True)  # -> Curve, Length, Domain
neg = Negative(Value=number_slider)
xy_2 = XYPlane(Origin=Point(0, 0, 0))
offset = OffsetCurve(Curve=nurbs.Curve, Distance=number_slider, Corners=3)
offset_2 = OffsetCurve(Curve=offset, Distance=neg, Plane=xy_2, Corners=1)
offset_3 = OffsetCurve(Curve=offset_2, Distance=neg, Plane=xy_2, Corners=1)
series = Series(Start=Slider(0.06, range=-2..5), Step=Slider(2.03, range=-2..5), Count=Slider(7, range=0..10))
offset_4 = OffsetCurve(Curve=nurbs.Curve, Distance=series, Corners=1)  # -> flatten(Curve)

debrep_2 = DeconstructBrep(Brep=item)  # -> Faces, Edges, Vertices
bang = ExplodeTree(Data=item)  # -> Branch0, Branch1, Branch2, Branch3
area = Area(Geometry=debrep_2.Faces)  # -> Area, Centroid
pdecon_2 = Deconstruct(Point=area.Centroid)  # -> XComponent, YComponent, ZComponent
brep_3 = Brep(bang.Branch3)
brep_4 = Brep(item)  # disabled
# https://macad.speckle.xyz/streams/4975f9f0a8/commits/8fbb543497
panel_2 = Panel()  # disabled
panel_3 = Panel()  # disabled
sort_2 = SortList(Keys=pdecon_2.ZComponent, ValuesA=debrep_2.Faces)  # -> Keys, ValuesA
brep_5 = Brep([<brep referenced from the Rhino model> x71])  # disabled
item_3 = ListItem(List=sort_2.ValuesA, Index=0, Wrap=True)  # -> Item1, Item
esokv = ExtendSpeckleObjectByKeyValue(Keys=panel_3, Values=panel_2, selectedKitName="Objects")  # disabled

# ---- group: Floors Grouped by Levels
trim = TrimTree(Tree=item_3.Item, Depth=1)

# ----
panel_4 = Panel("https://macad.speckle.xyz/streams/4975f9f0a8/branches/site%2F04-community-site")  # disabled
area_2 = Area(Geometry=trim)  # -> Area, Centroid
Z = UnitZ(Factor="-1")
move = Move(Geometry=area_2.Centroid, Motion=Z)  # -> Geometry, Transform
panel_5 = Panel("First one here :)")  # disabled
project_2 = ProjectPoint(Point=move.Geometry, Direction=Vector(0, 0, -1), Geometry=flatten(trim))  # -> Point, Index
bbox = BoundingBox(Content=brep_5, Plane=PlaneXY(0, 0, 0), UnionBox=True)  # -> Box, Box_2; disabled
number_slider_2 = Slider(100, range=0..1000)  # disabled
null = NullItem(Item=project_2.Point)  # -> NullFlags, InvalidFlags, Description
volume_2 = Volume(Geometry=bbox.Box_2)  # -> Volume, Centroid; disabled

# ---- group: Floors by Levels (no duplication)
cull_3 = CullPattern(List=trim, CullPattern=null.NullFlags)

# ----
send = Send(
    Stream=panel_4,
    Message=panel_5,
    Brep=brep_5,
    AutoSend=False,
    BaseId="4211a9499277c30a864f8af716dcf53c",
    CurrentComponentState="expired",
    KitName="Objects",
    OutputWrappers="https://macad.speckle.xyz\t4975f9f0a8\t25e44ca5db",
    UseDefaultCache=True,
    selectedKitName="Objects")  # disabled
# https://macad.speckle.xyz/streams/4975f9f0a8/commits/d13e3ec6c6
sph = Sphere(Base=volume_2.Centroid, Radius=number_slider_2)  # disabled
edges = BrepEdges(Brep=cull_3)  # -> Naked, Interior, NonManifold
join_2 = BrepJoin(Breps=cull_3)  # -> Breps, Closed

crv = Curve(item_2.Item1)
disc_2 = Discontinuity(Curve=crv, Level=1)  # -> Points, Parameters
nurbs_2 = NurbsCurve(Vertices=disc_2.Points, Degree=3, Periodic=True)  # -> Curve, Length, Domain

panel_6 = Panel("""ELEMENTAL MARS
G06
VOLUME
MULTIPLE
SITE-PLACE HOLDER
NO MATERIAL""")  # disabled
panel_7 = Panel("""BIMSC-PROJECT
BIMSC-ORIGINATOR
BIMSC-VOLUME
BIMSC-LEVEL
BIMSC-TYPE
BIMSC-MATERIAL""")  # disabled
edges_2 = BrepEdges(Brep=join_2.Breps)  # -> Naked, Interior, NonManifold
trim_2 = TrimTree(Tree=edges.Naked, Depth=1)
pt_2 = Point([<point referenced from the Rhino model> x4])
# https://macad.speckle.xyz/streams/4975f9f0a8/commits/8fbb543497
dso = DeconstructSpeckleObject(selectedKitName="Objects")  # disabled
geo = Geometry(edges_2.Naked)

# ---- group: G06 Stream
panel_8 = Panel("https://macad.speckle.xyz/streams/4975f9f0a8/branches/students%2Fg06-site_locations")  # disabled

# ----
number_slider_3 = Slider(3, range=0..20)  # disabled
panel_9 = Panel("A4")  # disabled
mesh_2 = Mesh(dso)  # disabled
boundary = BoundarySurfaces(Edges=geo)
rev = ReverseList(List=pt_2)
esokv_2 = ExtendSpeckleObjectByKeyValue(SpeckleObject=brep_4, Keys=panel_7, Values=panel_6, selectedKitName="Objects")  # disabled
sovk = SpeckleObjectValueByKey(Key=panel_9, selectedKitName="Objects")  # disabled
area_3 = Area(Geometry=boundary)  # -> Area, Centroid
cps = ClosestPoints(Point=pt_2, Cloud=disc_2.Points, Count="24")  # -> ClosestPoint, CPIndex, Distance
cir = Circle(Plane=pt_2, Radius=1)  # -> graft(Circle)
panel_10 = Panel("Footprint")  # disabled
dso_2 = DeconstructSpeckleObject(selectedKitName="Objects")  # disabled
trim_3 = TrimTree(Tree=area_3.Centroid, Depth=1)
item_4 = ListItem(List=flatten(mesh_2), Index=number_slider_3, Wrap=True)  # disabled
disc_3 = Discontinuity(Curve=geo, Level=1)  # -> flatten(Points), Parameters
pdecon_3 = Deconstruct(Point=trim_3)  # -> XComponent, YComponent, ZComponent
alongcrv = SortAlongCurve(Points=cps.ClosestPoint, Curve=cir)  # -> Points, Indices
send_2 = Send(
    Stream=panel_8,
    Message=panel_10,
    Data=esokv_2,
    AutoSend=False,
    BaseId="5c085f5baf2f57c841840d9e65b2c551",
    CurrentComponentState="expired",
    KitName="Objects",
    OutputWrappers="https://macad.speckle.xyz\t4975f9f0a8\t123ad7dd3c",
    UseDefaultCache=True,
    selectedKitName="Objects")  # disabled
# Speckle
panel_11 = Panel(dso_2)  # disabled
preview = CustomPreview(Geometry=boundary, Material=ColourSwatch(SwatchColor=RGB(117, 117, 117)))
item_5 = ListItem(List=pdecon_3.ZComponent, Index=0, Wrap=True)
merge = Merge(Data1=Slider(1, range=0..23), Data2=Slider(1, range=0..23), Data3=Slider(1, range=0..23), Data4=Slider(7, range=0..23))  # -> graft(Result)
pt_3 = Point(<point referenced from the Rhino model>)
shift = ShiftList(List=alongcrv.Points, Shift=merge, Wrap=True)
pdecon_4 = Deconstruct(Point=pt_3)  # -> XComponent, YComponent, ZComponent
flatten = FlattenTree(Tree=item_5, Path="{0}")
pline = PolyLine(Vertices=shift, Closed=True)
roundd = RoundToDecimalPlace(NumberX=pdecon_4.XComponent, DecimalPlace="2", RoundType=0)  # -> Rounded, Difference
roundd_2 = RoundToDecimalPlace(NumberX=pdecon_4.YComponent, DecimalPlace="2", RoundType=0)  # -> Rounded, Difference
boundary_2 = BoundarySurfaces(Edges=pline)
points = PointList(Points=shift, Size=Slider(1, range=0..10))
item_6 = ListItem(List=flatten, Index=Slider(3, range=0..3), Wrap=True)
panel_12 = Panel(roundd_2.Rounded)
panel_13 = Panel(roundd.Rounded)
panel_14 = Panel(item_6)
area_4 = Area(Geometry=boundary_2)  # -> Area, Centroid
pdecon_5 = Deconstruct(Point=area_4.Centroid)  # -> XComponent, YComponent, ZComponent
subtraction = Subtraction(A=item_5, B=pdecon_5.ZComponent)
Z_2 = UnitZ(Factor=subtraction)
move_2 = Move(Geometry=boundary_2, Motion=Z_2)  # -> Geometry, Transform

# ----
# TURN OFF
# BEFORE
# OPENING
# RHINO
# FILE
toggle_2 = GroupToggle(ToggleActive=True, ToggleVisible=False)  # disabled

# ----
# Pavilions Outline - Curved
number_slider_4 = Slider(-0.4, range=-2..2)
brep_6 = Brep(item)
volume_3 = Volume(Geometry=brep_6)  # -> Volume, Centroid
plfit = PlaneFit(Points=flatten(volume_3.Centroid))  # -> Plane, Deviation
Z_3 = UnitZ(Factor=Slider(1.5, range=-5..5))
offset_5 = OffsetCurve(Curve=nurbs_2.Curve, Distance=number_slider_4, Corners=1)
Z_4 = UnitZ(Factor=Slider(-1.2, range=-5..0))
move_3 = Move(Geometry=plfit.Plane, Motion=Z_3)  # -> Geometry, Transform
move_4 = Move(Geometry=plfit.Plane, Motion=Z_4)  # -> Geometry, Transform
Z_5 = UnitZ(Factor=1)
projecta = ProjectAlong(Geometry=offset_5, Plane=move_3.Geometry, Direction=Z_5)  # -> Geometry, Transform

Z_6 = UnitZ(Factor=1)
projecta_2 = ProjectAlong(Geometry=offset_4, Plane=move_4.Geometry, Direction=Z_6)  # -> Geometry, Transform

# ----
# Pavilions Ground
projecta_3 = ProjectAlong(Geometry=crv, Plane=move_4.Geometry, Direction=Z_6)  # -> Geometry, Transform
patch = Patch(Points=disc_3.Points, Spans=20, Flexibility=5, Trim=True)
project_3 = Project(Curve=crv, Brep=patch, Direction=Vector(0, 0, 1))
srfsplit = SurfaceSplit(Surface=patch, Curves=project_3)
boundary_3 = BoundarySurfaces(Edges=projecta_3.Geometry)
item_7 = ListItem(List=srfsplit, Index="1", Wrap=True)
swatch = ColourSwatch(SwatchColor=RGB(77, 87, 62))
contour = Contour(Shape=item_7, Point=Point(0, 0, 0), Direction=Vector(0, 0, 1), Distance="0.5")
preview_2 = CustomPreview(Geometry=item_7, Material=ColourSwatch(SwatchColor=RGB(99, 99, 99)))  # disabled

# ----
# Units (Pebbles)
brep_7 = Brep(item)
mesh_3 = MeshBrep(
    Brep=brep_7,
    Settings={GridMaxCount=0, GridMinCount=16, JaggedSeams=False, MaxEdgeLength=0, MinEdgeLength=0.0001, MinTolerance=0, Refine=True, RefineAngle=0, RelativeTolerance=0.65, SimplePlanes=True, Tolerance=0})
wbcatmullclark = WeaverbirdsCatmullClarkSubdivision(MeshCurves=mesh_3, Level=Slider(2, range=0..2), SmoothNakedEdges=Slider(0, range=0..2))
preview_3 = CustomPreview(Geometry=brep_7, Material=ColourSwatch(SwatchColor=RGBA(189, 189, 189, 205)))  # disabled
preview_4 = CustomPreview(Geometry=wbcatmullclark, Material=ColourSwatch(SwatchColor=RGB(145, 142, 132)))  # disabled

panel_15 = Panel("""0
0
1""")

# ---- group: Original Wall Control Points
# Pavilions Outline - Dispatched Points
pt_4 = Point(disc_2.Points)

# ----
Z_7 = UnitZ(Factor=Slider(-0.5, range=-10..10))
move_5 = Move(Geometry=patch, Motion=Z_7)  # -> Geometry, Transform
cull_4 = CullPattern(List=pt_4, CullPattern=invert(panel_15))
cull_5 = CullPattern(List=pt_4, CullPattern=panel_15)
partition = PartitionList(List=cull_4, Size="2")
avr = Average(Input=partition)
scale = Scale(Geometry=partition, Center=avr, Factor=Slider(0.16, range=0..1))  # -> flatten(Geometry), Transform

crv_cp = CurveClosestPoint(Point=cull_5, Curve=offset_5)  # -> Point, Parameter, Distance
eval = EvaluateCurve(Curve=offset_5, Parameter=crv_cp.Parameter)  # -> Point, Tangent, Angle
rotate = Rotate(Geometry=eval.Tangent, Angle=1.570796327, Plane=PlaneXY(0, 0, 0))  # -> Geometry, Transform
amp = Amplitude(Vector=rotate.Geometry, Amplitude=Slider(4, range=-10..10))
vdis = VectorDisplay(Anchor=eval.Point, Vector=rotate.Geometry)
move_6 = Move(Geometry=cull_5, Motion=amp)  # -> Geometry, Transform

crv_cp_2 = CurveClosestPoint(Point=scale.Geometry, Curve=offset_5)  # -> Point, Parameter, Distance
eval_2 = EvaluateCurve(Curve=offset_5, Parameter=crv_cp_2.Parameter)  # -> Point, Tangent, Angle
rotate_2 = Rotate(Geometry=eval_2.Tangent, Angle=1.570796327, Plane=PlaneXY(0, 0, 0))  # -> Geometry, Transform
amp_2 = Amplitude(Vector=rotate_2.Geometry, Amplitude=Slider(-0.5, range=-10..10))
vdis_2 = VectorDisplay(Anchor=eval_2.Point, Vector=rotate_2.Geometry)
move_7 = Move(Geometry=cull_4, Motion=amp_2)  # -> Geometry, Transform

previewlw = CustomPreviewLineweights(
    Geometry=contour,
    Shader=ColourSwatch(SwatchColor=RGB(255, 255, 255)),
    Thickness=Slider(3.07, range=0..5),
    Absolute=False)

# ---- group: 1s
index = ItemIndex(List=pt_4, Item=cull_5)

# ---- group: 2s
index_2 = ItemIndex(List=pt_4, Item=cull_4)

# ----
panel_16 = Panel("""0
1
12
13
16
17
32
33
44
45
48
49""")
replace = ReplaceItems(List=pt_4, Item=move_6.Geometry, Indices=index, Wrap=False)
item_8 = ListItem(List=cull_4, Index=panel_16, Wrap=True)

crv_cp_3 = CurveClosestPoint(Point=item_8, Curve=offset_5)  # -> Point, Parameter, Distance
eval_3 = EvaluateCurve(Curve=offset_5, Parameter=crv_cp_3.Parameter)  # -> Point, Tangent, Angle
rotate_3 = Rotate(Geometry=eval_3.Tangent, Angle=1.570796327, Plane=PlaneXY(0, 0, 0))  # -> Geometry, Transform
vdis_3 = VectorDisplay(Anchor=eval_3.Point, Vector=rotate_3.Geometry)
amp_3 = Amplitude(Vector=rotate_3.Geometry, Amplitude=Slider(0.5, range=-10..10))
move_8 = Move(Geometry=item_8, Motion=amp_3)  # -> Geometry, Transform

crv_2 = Curve([<curve referenced from the Rhino model> x24])
crv_3 = Curve([<curve referenced from the Rhino model> x24])
crv_4 = Curve([<curve referenced from the Rhino model> x24])
crv_5 = Curve([<curve referenced from the Rhino model> x24])
replace_2 = ReplaceItems(List=replace, Item=move_7.Geometry, Indices=index_2, Wrap=False)
join_3 = JoinCurves(Curves=crv_2, Preserve=False)
join_4 = JoinCurves(Curves=crv_3, Preserve=False)
join_5 = JoinCurves(Curves=crv_4, Preserve=False)
join_6 = JoinCurves(Curves=crv_5, Preserve=False)
panel_17 = Panel("""0
1
18
19
24
25
48
49
66
67
72
73""")
boundary_4 = BoundarySurfaces(Edges=join_3)
boundary_5 = BoundarySurfaces(Edges=join_4)
boundary_6 = BoundarySurfaces(Edges=join_6)
boundary_7 = BoundarySurfaces(Edges=join_5)
replace_3 = ReplaceItems(List=replace_2, Item=item_8, Indices=panel_17, Wrap=False)
merge_2 = Merge(Data1=boundary_4, Data2=boundary_5, Data3=boundary_6, Data4=boundary_7)
Z_8 = UnitZ(Factor=Slider(3.5, range=-5..15))
nurbs_3 = NurbsCurve(Vertices=replace_3, Degree=3, Periodic=True)  # -> Curve, Length, Domain
move_9 = Move(Geometry=patch, Motion=Z_8)  # -> Geometry, Transform

# ---- group: Floors Reference Planes
srf = Surface(merge_2)

# ----
project_4 = ProjectPoint(Point=replace_3, Direction=Vector(0, 0, -1), Geometry=move_9.Geometry)  # -> Point, Index
edges_3 = BrepEdges(Brep=srf)  # -> Naked, Interior, NonManifold
Z_9 = UnitZ(Factor=Slider(2, range=-5..5))
panel_18 = Panel(srf)
join_7 = JoinCurves(Curves=edges_3.Naked, Preserve=False)  # -> flatten(Curves)
item_9 = ListItem(List=project_4.Point, Index=index, Wrap=True)
preview_5 = CustomPreview(Geometry=srf, Material=ColourSwatch(SwatchColor=RGB(242, 255, 0)))
move_10 = Move(Geometry=item_9, Motion=Z_9)  # -> Geometry, Transform
panel_19 = Panel("""0
1
18
19
24
25
48
49
66
67
72
73""")
replace_4 = ReplaceItems(List=project_4.Point, Item=move_10.Geometry, Indices=index, Wrap=False)
materials = QueryMaterials()
item_10 = ListItem(List=replace_4, Index=panel_19, Wrap=True)
Z_10 = UnitZ(Factor=Slider(2.06, range=0..10))
move_11 = Move(Geometry=item_10, Motion=Z_10)  # -> Geometry, Transform
project_5 = Project(Curve=offset_5, Brep=patch, Direction=Vector(0, 0, 1))  # -> flatten(Curve)
Z_11 = UnitZ(Factor=Slider(1, range=-10..10))
project_6 = Project(Curve=offset_5, Brep=patch, Direction=Vector(0, 0, 1))
Z_12 = UnitZ(Factor=Slider(-0.5, range=-10..10))
replace_5 = ReplaceItems(List=replace_4, Item=move_11.Geometry, Indices=panel_19, Wrap=False)
move_12 = Move(Geometry=project_5, Motion=Z_12)  # -> Geometry, Transform
move_13 = Move(Geometry=project_6, Motion=Z_11)  # -> Geometry, Transform
number_slider_5 = Slider(0.3, range=0..1)
number_slider_6 = Slider(0.2, range=0..1)
rebcrv = RebuildCurve(Curve=move_13.Geometry, EndTangents=False)
rebcrv_2 = RebuildCurve(Curve=move_12.Geometry, EndTangents=False)
nurbs_4 = NurbsCurve(Vertices=replace_5, Degree=3, Periodic=True)  # -> Curve, Length, Domain
Z_13 = UnitZ(Factor=number_slider_5)
Z_14 = UnitZ(Factor=number_slider_5)
move_14 = Move(Geometry=nurbs_4.Curve, Motion=Z_13)  # -> Geometry, Transform
xy_3 = XYPlane(Origin=Point(0, 0, 0))
offset_6 = OffsetCurve(Curve=move_14.Geometry, Distance=Slider(-0.39, range=-1..0), Plane=xy_3, Corners=1)
previewlw_2 = CustomPreviewLineweights(
    Geometry=[nurbs_4.Curve, move_13.Geometry, move_12.Geometry],
    Shader=ColourSwatch(SwatchColor=RGB(153, 0, 0)),
    Thickness=Slider(6.3, range=0..10),
    Absolute=False)

# ---- group: Doors Locations
# Doors
crv_6 = Curve([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])

# ----
# Openings
crv_7 = Curve(crv_6)
disc_4 = Discontinuity(Curve=crv_7, Level=1)  # -> Points, Parameters
area_5 = Area(Geometry=crv_7)  # -> Area, Centroid
nurbs_5 = NurbsCurve(Vertices=disc_4.Points, Degree=3, Periodic=True)  # -> Curve, Length, Domain
scale_2 = Scale(Geometry=flatten(nurbs_5.Curve), Center=area_5.Centroid, Factor=Slider(0.74, range=0..1))  # -> Geometry, Transform
boundary_8 = BoundarySurfaces(Edges=scale_2.Geometry)
offsrf = OffsetSurface(Surface=boundary_8, Distance=Slider(2.4, range=-3..5), BothSides=0, CreateSolid=True)
join_8 = BrepJoin(Breps=flatten(offsrf))  # -> Breps, Closed
Z_15 = UnitZ(Factor=Slider(-0.4, range=-2..2))
move_15 = Move(Geometry=join_8.Breps, Motion=Z_15)  # -> Geometry, Transform

# ----
# Windows
crv_8 = Curve([<curve referenced from the Rhino model> x10])
pt_5 = Point(<point referenced from the Rhino model>)
crv_9 = Curve([<curve referenced from the Rhino model> x6])
pt_6 = Point(<point referenced from the Rhino model>)
pt_7 = Point(<point referenced from the Rhino model>)
crv_10 = Curve([<curve referenced from the Rhino model> x4])
crv_11 = Curve([<curve referenced from the Rhino model> x12])
pt_8 = Point(<point referenced from the Rhino model>)
disc_5 = Discontinuity(Curve=crv_8, Level=1)  # -> Points, Parameters
disc_6 = Discontinuity(Curve=crv_9, Level=1)  # -> Points, Parameters
disc_7 = Discontinuity(Curve=crv_10, Level=1)  # -> Points, Parameters
disc_8 = Discontinuity(Curve=crv_11, Level=1)  # -> Points, Parameters
number_slider_7 = Slider(0.36, range=0..1)
number_slider_8 = Slider(1.62, range=0..2)
nurbs_6 = NurbsCurve(Vertices=disc_5.Points, Degree=3, Periodic=True)  # -> Curve, Length, Domain
nurbs_7 = NurbsCurve(Vertices=disc_6.Points, Degree=3, Periodic=True)  # -> Curve, Length, Domain
nurbs_8 = NurbsCurve(Vertices=disc_7.Points, Degree=3, Periodic=True)  # -> Curve, Length, Domain
nurbs_9 = NurbsCurve(Vertices=disc_8.Points, Degree=3, Periodic=True)  # -> Curve, Length, Domain
area_6 = Area(Geometry=nurbs_6.Curve)  # -> Area, Centroid
area_7 = Area(Geometry=nurbs_8.Curve)  # -> Area, Centroid
area_8 = Area(Geometry=nurbs_7.Curve)  # -> Area, Centroid
area_9 = Area(Geometry=nurbs_9.Curve)  # -> Area, Centroid
scale_3 = Scale(Geometry=nurbs_6.Curve, Center=area_6.Centroid, Factor=number_slider_7)  # -> Geometry, Transform
scale_4 = Scale(Geometry=nurbs_8.Curve, Center=area_7.Centroid, Factor=number_slider_7)  # -> Geometry, Transform
scale_5 = Scale(Geometry=nurbs_7.Curve, Center=area_8.Centroid, Factor=number_slider_7)  # -> Geometry, Transform
scale_6 = Scale(Geometry=nurbs_9.Curve, Center=area_9.Centroid, Factor=number_slider_7)  # -> Geometry, Transform
scale_nu = ScaleNU(Geometry=scale_3.Geometry, Plane=area_6.Centroid, ScaleX=1, ScaleY=1, ScaleZ=number_slider_8)  # -> Geometry, Transform
scale_nu_2 = ScaleNU(Geometry=scale_5.Geometry, Plane=area_8.Centroid, ScaleX=1, ScaleY=1, ScaleZ=number_slider_8)  # -> Geometry, Transform
scale_nu_3 = ScaleNU(Geometry=scale_4.Geometry, Plane=area_7.Centroid, ScaleX=1, ScaleY=1, ScaleZ=number_slider_8)  # -> Geometry, Transform
scale_nu_4 = ScaleNU(Geometry=scale_6.Geometry, Plane=area_9.Centroid, ScaleX=1, ScaleY=1, ScaleZ=number_slider_8)  # -> Geometry, Transform
ln = Line(StartPoint=area_9.Centroid, EndPoint=pt_8)
ln_2 = Line(StartPoint=area_7.Centroid, EndPoint=pt_7)
ln_3 = Line(StartPoint=area_6.Centroid, EndPoint=pt_5)
ln_4 = Line(StartPoint=area_8.Centroid, EndPoint=pt_6)
extrcrv = ExtrudeAlong(Base=scale_nu.Geometry, Curve=ln_3)
extrcrv_2 = ExtrudeAlong(Base=scale_nu_2.Geometry, Curve=ln_4)
extrcrv_3 = ExtrudeAlong(Base=scale_nu_3.Geometry, Curve=ln_2)
extrcrv_4 = ExtrudeAlong(Base=scale_nu_4.Geometry, Curve=ln)
cap = CapHoles(Brep=extrcrv)
cap_2 = CapHoles(Brep=extrcrv_2)
# To Revit...  and Beyond
cap_3 = CapHoles(Brep=extrcrv_3)
cap_4 = CapHoles(Brep=extrcrv_4)

loft_opt = LoftOptions(Closed=False, Adjust=True, Rebuild=Slider(800, range=0..1000), Refit=0, Type=Slider(0, range=0..5))

# ----
# Wall
merge_3 = Merge(Data1=flatten(nurbs_4.Curve), Data2=flatten(rebcrv), Data3=flatten(rebcrv_2))
toggle_3 = GroupToggle(ToggleActive=True, ToggleVisible=False)  # disabled
loft = Loft(Curves=merge_3, Options=loft_opt)
offsrf_2 = OffsetSurface(Surface=loft, Distance=Slider(-0.3, range=-1..1), BothSides=0, CreateSolid=True)

item_11 = ListItem(List=join_7, Index=0, Wrap=True)  # -> Item, Item1, Item2, Item3; disabled
merge_4 = Merge(Data1=cap, Data2=cap_2, Data3=cap_3, Data4=cap_4)  # -> flatten(Result)
levels = QueryLevels(BuildingStory=True)

# ---- group: Building Pads
join_9 = JoinCurves(Curves=geo, Preserve=False)  # -> flatten(Curves)

# ----
debrep_3 = DeconstructBrep(Brep=offsrf_2)  # -> Faces, Edges, Vertices
item_12 = ListItem(List=debrep_3.Edges, Index=Slider(2, range=0..7), Wrap=True)
rulesrf = RuledSurface(CurveA=move_14.Geometry, CurveB=offset_6)
project_7 = Project(Curve=item_12, Brep=rulesrf, Direction=Vector(0, 0, 1))
rulesrf_2 = RuledSurface(CurveA=project_7, CurveB=item_12)
extr = Extrude(Base=nurbs_4.Curve, Direction=Z_14)
rulesrf_3 = RuledSurface(CurveA=move_14.Geometry, CurveB=project_7)
item_13 = ListItem(List=debrep_3.Faces, Index=Slider(3, range=0..7), Wrap=True)
merge_5 = Merge(Data1=flatten(extr), Data2=flatten(rulesrf_3), Data3=flatten(rulesrf_2), Data4=flatten(item_13))
join_10 = BrepJoin(Breps=merge_5)  # -> Breps, Closed

# ---- group: Roof Mesh
mesh_4 = Mesh(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)

# ----
brep_8 = Brep(<brep referenced from the Rhino model>)
brep_9 = Brep(<brep referenced from the Rhino model>)
brep_10 = Brep(<brep referenced from the Rhino model>)
brep_11 = Brep(<brep referenced from the Rhino model>)
item_14 = ListItem(Index=0, Wrap=True)  # -> Item, Item1, Item2, Item3
sdiff = SolidDifference(BrepsA=offsrf_2, BrepsB=[move_15.Geometry, merge_4])
edges_4 = BrepEdges(Brep=brep_8)  # -> Naked, Interior, NonManifold
edges_5 = BrepEdges(Brep=brep_9)  # -> Naked, Interior, NonManifold
edges_6 = BrepEdges(Brep=brep_10)  # -> Naked, Interior, NonManifold
edges_7 = BrepEdges(Brep=brep_11)  # -> Naked, Interior, NonManifold
item_15 = ListItem(List=join_9, Index=0, Wrap=True)  # -> Item, Item1, Item2, Item3, Item4, Item5, Item6, Item7, Item8
trigger = Trigger(Interval=-1000, TimerInterval=1000, Target=g_shape_3)

# ---- group: Pavilions
geo_2 = Geometry([<brep referenced from the Rhino model> x26, <curve referenced from the Rhino model>, <brep referenced from the Rhino model>])

# ----
swatch_2 = ColourSwatch(SwatchColor=RGB(166, 140, 108))
join_11 = JoinCurves(Curves=edges_7.Naked, Preserve=False)
join_12 = JoinCurves(Curves=edges_6.Naked, Preserve=False)
join_13 = JoinCurves(Curves=edges_4.Naked, Preserve=False)
join_14 = JoinCurves(Curves=edges_5.Naked, Preserve=False)
preview_6 = CustomPreview(Geometry=sdiff, Material=ColourSwatch(SwatchColor=RGB(166, 40, 40)))
g_shape = AddDirectShapeGeometry(Category=<geometry referenced from the Revit model>, Geometry=mesh_4, TrackingMode=2)
g_shape_2 = AddDirectShapeGeometry(Category=<geometry referenced from the Revit model>, Geometry=sdiff, TrackingMode=2)
Z_16 = UnitZ(Factor=Slider(0.18, range=0..1))
g_shape_3 = AddDirectShapeGeometry(Category=<missing>, Geometry=geo_2, TrackingMode=2)
buildingpad = AddBuildingPad(Boundary=item_15.Item1, Level=item_14.Item1, TrackingMode=2)  # disabled
buildingpad_2 = AddBuildingPad(Boundary=item_15.Item1, Level=item_14.Item1, TrackingMode=2)  # disabled
buildingpad_3 = AddBuildingPad(Boundary=item_15.Item2, Level=item_14.Item1, TrackingMode=2)  # disabled
move_16 = Move(Geometry=nurbs_4.Curve, Motion=Z_16)  # -> Geometry, Transform
buildingpad_4 = AddBuildingPad(Boundary=item_15.Item7, Level=item_14.Item3, TrackingMode=2)  # disabled
buildingpad_5 = AddBuildingPad(Boundary=item_15.Item8, Level=item_14.Item3, TrackingMode=2)  # disabled
trigger_2 = Trigger(
    Interval=-1000,
    TimerInterval=1000,
    Target=[buildingpad_10, buildingpad_2, buildingpad_3, buildingpad_6, buildingpad_8, buildingpad_7, buildingpad_9, buildingpad_4, buildingpad_5, buildingpad])
buildingpad_6 = AddBuildingPad(Boundary=item_15.Item3, Level=item_14.Item2, TrackingMode=2)  # disabled
buildingpad_7 = AddBuildingPad(Boundary=item_15.Item5, Level=item_14.Item2, TrackingMode=2)  # disabled
buildingpad_8 = AddBuildingPad(Boundary=item_15.Item4, Level=item_14.Item2, TrackingMode=2)  # disabled
buildingpad_9 = AddBuildingPad(Boundary=item_15.Item6, Level=item_14.Item2, TrackingMode=2)  # disabled
trigger_3 = Trigger(Interval=-1000, TimerInterval=1000, Target=topography)
buildingpad_10 = AddBuildingPad(Boundary=item_15.Item, Level=item_14.Item, TrackingMode=2)  # disabled
trigger_4 = Trigger(Interval=-1000, TimerInterval=1000, Target=[buildingpad_13, buildingpad_12, buildingpad_11, buildingpad_14])  # disabled
buildingpad_11 = AddBuildingPad(Boundary=join_11, Level=item_14.Item3, TrackingMode=2)
buildingpad_12 = AddBuildingPad(Boundary=join_14, Level=item_14.Item1, TrackingMode=2)
buildingpad_13 = AddBuildingPad(Boundary=join_13, Level=item_14.Item, TrackingMode=2)
offsrf_3 = OffsetSurface(Surface=item_13, Distance=Slider(0.15, range=0..1), BothSides=0, CreateSolid=True)
buildingpad_14 = AddBuildingPad(Boundary=join_12, Level=item_14.Item2, TrackingMode=2)
category_types = CategoryTypes({"Model": 1, "Annotation": 2, "Internal": 4, "Analytical": 5}, selected="Model")
debrep_4 = DeconstructBrep(Brep=offsrf_3)  # -> Faces, Edges, Vertices
item_16 = ListItem(List=debrep_4.Edges, Index=0, Wrap=True)

# ---- group: Anchors
pt_9 = Point([<point referenced from the Rhino model> x4])

pt_10 = Point([<point referenced from the Rhino model> x4])

# ----
preview_7 = CustomPreview(Geometry=offsrf_3, Material=ColourSwatch(SwatchColor=RGB(0, 163, 0)))  # disabled
Y = UnitY(Factor=250)
move_17 = Move(Motion=Y)  # -> Geometry, Transform

crv_12 = Curve([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])  # disabled
toggle_4 = GroupToggle(ToggleActive=True, ToggleVisible=False)  # disabled
number_slider_9 = Slider(3, range=0..10)  # disabled
number_slider_10 = Slider(0.61, range=0..1)  # disabled
number_slider_11 = Slider(0.37, range=0..1)  # disabled
boundary_9 = BoundarySurfaces(Edges=crv_12)  # disabled
quads = QuadPanels(Surface=boundary_9, UDivisions=number_slider_9, VDivisions=number_slider_9)  # disabled
dom = ConstructDomain(DomainStart=number_slider_10, DomainEnd=number_slider_11)  # disabled
area_10 = Area(Geometry=quads)  # -> Area, Centroid; disabled
area_11 = Area(Geometry=crv_12)  # -> Area, Centroid; disabled
graph = GraphMapper(
    dom,
    x0=0,
    x1=1,
    y0=0,
    y1=1,
    container_name="Bezier",
    cpx=[0, 0.2898975313, 0.5899852514, 1],
    cpy=[0, 0, 0.8516721725, 0.8945418596])  # disabled
dist = Distance(PointA=graft(area_11.Centroid), PointB=area_10.Centroid)  # disabled
bnd = Bounds(Numbers=dist)  # disabled
remap = RemapNumbers(Value=dist, Source=bnd, Target=graph)  # -> Mapped, Clipped; disabled
scale_7 = Scale(Geometry=quads, Center=area_10.Centroid, Factor=remap.Mapped)  # -> Geometry, Transform; disabled
debrep_5 = DeconstructBrep(Brep=scale_7.Geometry)  # -> Faces, Edges, Vertices; disabled
number_slider_12 = Slider(3, range=0..3)  # disabled
item_17 = ListItem(List=debrep_5.Vertices, Index=0, Wrap=True)  # -> Item, Item1, Item2, Item3; disabled
pt_11 = Point([item_17.Item1, item_17.Item3])  # disabled
area_12 = Area(Geometry=debrep_5.Faces)  # -> Area, Centroid; disabled
reb = RebuildCurve(Curve=scale_7.Geometry, Degree=number_slider_12, Count=10, Tangents=False)  # disabled
number_slider_13 = Slider(0.51, range=0..1)  # disabled
scale_8 = Scale(Geometry=pt_11, Center=area_12.Centroid, Factor=number_slider_13)  # -> Geometry, Transform; disabled
pt_12 = Point([item_17.Item, item_17.Item2])  # disabled
item_18 = ListItem(List=scale_8.Geometry, Index=0, Wrap=True)  # -> Item, Item1; disabled
item_19 = ListItem(List=pt_12, Index=0, Wrap=True)  # -> Item, Item1; disabled
number_slider_14 = Slider(3, range=0..3)  # disabled
merge_6 = Merge(Data1=item_19.Item1, Data2=item_18.Item, Data3=item_19.Item, Data4=item_18.Item1)  # disabled
number_slider_15 = Slider(2, range=0..5)  # disabled
item_20 = ListItem(List=merge_6, Index=number_slider_14, Wrap=True)  # disabled
nurbs_10 = NurbsCurve(Vertices=merge_6, Degree=number_slider_15, Periodic=True)  # -> Curve, Length, Domain; disabled
intcrv = Interpolate(Vertices=merge_6, Degree=3, Periodic=True, KnotStyle=1)  # -> Curve, Length, Domain; disabled

Z_17 = UnitZ(Factor="-1")
Z_18 = UnitZ(Factor=Slider(0.15, range=0..1))
Z_19 = UnitZ(Factor=Slider(0.15, range=0..1))
Z_20 = UnitZ(Factor="-1")
Z_21 = UnitZ(Factor="-1")
neg_2 = Negative(Value="0.025")
neg_3 = Negative(Value="0.025")

triremesh = TriRemesh(Geometry=mesh, Iterations=25)  # -> Triangulation, Dual, Creases
# Terrain
medges = MeshEdges(Mesh=triremesh.Triangulation)  # -> NakedEdges, InteriorEdges, NonManifoldEdges
dom_2 = ConstructDomain(DomainStart=Slider(0.49, range=0..1), DomainEnd=Slider(0.69, range=0..1))
dom_3 = ConstructDomain(DomainStart=Slider(0.4, range=0..1), DomainEnd=Slider(0.55, range=0..1))
dom² = ConstructDomain²(DomainU=dom_2, DomainV=dom_3)

item_21 = ListItem(List=triremesh.Triangulation, Index="1", Wrap=True)
Z_22 = UnitZ(Factor=1)
move_18 = Move(Geometry=item_21, Motion=Z_22)  # -> Geometry, Transform
medges_2 = MeshEdges(Mesh=move_18.Geometry)  # -> NakedEdges, InteriorEdges, NonManifoldEdges
previewlw_3 = CustomPreviewLineweights(
    Geometry=medges_2.NakedEdges,
    Shader=ColourSwatch(SwatchColor=RGB(0, 0, 0)),
    Thickness=Slider(2, range=0..100),
    Absolute=False)

contour_2 = Contour(Shape=item_21, Point=Point(0, 0, 0), Direction=Vector(0, 0, 1), Distance=Slider(1, range=0..50))
patch_2 = Patch(Curves=flatten(contour_2), Spans=20, Flexibility=1, Trim=True)

preview_8 = CustomPreview(Geometry=item_21, Material=ColourSwatch(SwatchColor=RGB(194, 194, 194)))  # disabled
subsrf = Isotrim(Surface=patch_2, Domain=dom²)

debrep_6 = DeconstructBrep(Brep=subsrf)  # -> Faces, Edges, Vertices
contour_3 = Contour(Shape=subsrf, Point=Point(0, 0, 0), Direction=Vector(0, 0, 1), Distance=Slider(1, range=0..50))
join_15 = JoinCurves(Curves=debrep_6.Edges, Preserve=False)
project_8 = Project(Curve=offset_4, Brep=subsrf, Direction=Vector(0, 0, 1))  # -> flatten(Curve)

# ---- group: Patch - Terrain
# Terrain & Contours (Patch)
toggle_5 = GroupToggle(ToggleActive=True, ToggleVisible=False)  # disabled
item_22 = ListItem(List=project_8, Index=0, Wrap=True)  # -> Item2, Item1, Item
Z_23 = UnitZ(Factor=Slider(1, range=0..6))
move_19 = Move(Geometry=geo, Motion=Z_23)  # -> Geometry, Transform
plfit_2 = PlaneFit(Points=debrep_6.Vertices)  # -> Plane, Deviation
offset_7 = OffsetCurve(Curve=join_15, Distance=Slider(-5, range=-5..5), Plane=plfit_2.Plane, Corners=1)  # -> flatten(Curve)
merge_7 = Merge(Data1=flatten(move_19.Geometry), Data2=item_22.Item2, Data3=join_15, Data4=offset_7)  # -> flatten(Result)
patch_3 = Patch(Curves=merge_7, Spans=20, Flexibility=Slider(5, range=1..15), Trim=True)
project_9 = Project(Curve=crv, Brep=patch_3, Direction=Vector(0, 0, 1))
srfsplit_2 = SurfaceSplit(Surface=patch_3, Curves=project_9)
item_23 = ListItem(List=srfsplit_2, Index=0, Wrap=True)
contour_4 = Contour(Shape=item_23, Point=Point(0, 0, 0), Direction=Vector(0, 0, 1), Distance="0.5")

# ---- group: Trimmed
mesh_5 = MeshBrep(
    Brep=item_23,
    Settings={GridMaxCount=0, GridMinCount=16, JaggedSeams=False, MaxEdgeLength=0, MinEdgeLength=0.0001, MinTolerance=0, Refine=True, RefineAngle=0, RelativeTolerance=0.65, SimplePlanes=True, Tolerance=0})

# ----
previewlw_4 = CustomPreviewLineweights(Geometry=contour_4, Shader=ColourSwatch(SwatchColor=RGB(0, 0, 0)), Thickness=Slider(1.9, range=0..5), Absolute=False)

# ---- group: Not Clipped
mesh_6 = MeshBrep(
    Brep=patch_3,
    Settings={GridMaxCount=0, GridMinCount=16, JaggedSeams=False, MaxEdgeLength=0, MinEdgeLength=0.0001, MinTolerance=0, Refine=True, RefineAngle=0, RelativeTolerance=0.65, SimplePlanes=True, Tolerance=0})

# ----
preview_9 = CustomPreview(Geometry=mesh_5, Material=ColourSwatch(SwatchColor=RGB(166, 140, 103)))  # disabled
triremesh_2 = TriRemesh(Geometry=mesh_6, Length=Slider(1, range=0..1), Iterations=25)  # -> Triangulation, Dual, Creases
medges_3 = MeshEdges(Mesh=triremesh_2.Triangulation)  # -> NakedEdges, InteriorEdges, NonManifoldEdges
mesh_7 = Mesh(triremesh_2.Triangulation)
unweld = UnweldMesh(Mesh=mesh_7, Angle=degrees(Slider(9, range=0..10)))
topography = AddTopographyMesh(Mesh=unweld, TrackingMode=2)  # disabled

toggle_6 = GroupToggle(ToggleActive=True, ToggleVisible=False)  # disabled
# Roof (Upper Layer)
cps_2 = ClosestPoints(Point=pt_9, Cloud=item_9, Count="8")  # -> ClosestPoint, CPIndex, Distance
crv_cp_4 = CurveClosestPoint(Point=cps_2.ClosestPoint, Curve=move_16.Geometry)  # -> Point, Parameter, Distance
avr_2 = Average(Input=crv_cp_4.Point)
cir_2 = Circle(Plane=avr_2, Radius=1)
alongcrv_2 = SortAlongCurve(Points=crv_cp_4.Point, Curve=cir_2)  # -> Points, Indices
vec2pt = Vector2Pt(PointA=alongcrv_2.Points, PointB=avr_2, Unitize=False)  # -> Vector, Length
shatter = Shatter(Curve=move_16.Geometry, Parameters=flatten(crv_cp_4.Parameter))
amp_4 = Amplitude(Vector=vec2pt.Vector, Amplitude=Slider(7, range=0..20))
move_20 = Move(Geometry=alongcrv_2.Points, Motion=amp_4)  # -> Geometry, Transform
ln_5 = Line(StartPoint=alongcrv_2.Points, EndPoint=move_20.Geometry)
panel_20 = Panel("""2
4""")
panel_21 = Panel("""0
6""")
panel_22 = Panel("""7
15
21
5
23
31""")
end = EndPoints(Curve=ln_5)  # -> Start, End
entwine = Entwine(Branch00="0", Branch01=panel_20, Branch02=panel_21, Branch03="4", FlattenInputs=True)
dispdexs = DispatchIndices(List=shatter, Indices=panel_22)  # -> AtI, NotI
shift_2 = ShiftList(List=end.End, Shift=1, Wrap=True)
ln_6 = Line(StartPoint=end.End, EndPoint=shift_2)
number_slider_16 = Slider(12, range=0..100)
partition_2 = PartitionList(List=dispdexs.AtI, Size="2")
end_2 = EndPoints(Curve=partition_2)  # -> Start, End
dispdexs_2 = DispatchIndices(List=ln_6, Indices=entwine)  # -> flatten(AtI), flatten(NotI)
shift_3 = ShiftList(List=end_2.End, Shift=1, Wrap=True)
ln_7 = Line(StartPoint=end_2.Start, EndPoint=shift_3)
divide = DivideCurve(Curve=ln_5, Count=number_slider_16, Kinks=False)  # -> Points, Tangents, Parameters
flatten_2 = FlattenTree(Tree=ln_7, Path="{0}")
divide_2 = DivideCurve(Curve=dispdexs.NotI, Count=number_slider_16, Kinks=False)  # -> Points, Tangents, Parameters
divide_3 = DivideCurve(Curve=partition_2, Count=number_slider_16, Kinks=False)  # -> Points, Tangents, Parameters
divide_4 = DivideCurve(Curve=ln_7, Count=number_slider_16, Kinks=False)  # -> Points, Tangents, Parameters
bang_2 = ExplodeTree(Data=simplify(divide_3.Points))  # -> Branch0, Branch1, Branch2, Branch3, Branch4, Branch5
rev_2 = ReverseList(List=bang_2.Branch1)
rev_3 = ReverseList(List=bang_2.Branch3)
rev_4 = ReverseList(List=bang_2.Branch5)
ln_8 = Line(StartPoint=bang_2.Branch0, EndPoint=rev_2)
ln_9 = Line(StartPoint=bang_2.Branch2, EndPoint=rev_3)
ln_10 = Line(StartPoint=bang_2.Branch4, EndPoint=rev_4)
divide_5 = DivideCurve(Curve=[ln_8, ln_9, ln_10], Count=number_slider_16, Kinks=False)  # -> Points, Tangents, Parameters
addition = Addition(A=number_slider_16, B="1")
trim_4 = TrimTree(Tree=divide_5.Points, Depth=1)
frompoints = MeshFromPoints(Points=trim_4, UDirection=addition, VDirection=addition)
shift_4 = ShiftList(List=divide.Points, Shift=1, Wrap=False)
shift_5 = ShiftList(List=divide_4.Points, Shift=1, Wrap=False)
shift_6 = ShiftList(List=divide_5.Points, Shift=1, Wrap=True)
ln_11 = Line(StartPoint=divide.Points, EndPoint=shift_4)
ln_12 = Line(StartPoint=divide_4.Points, EndPoint=shift_5)
ln_13 = Line(StartPoint=divide_5.Points, EndPoint=shift_6)
cull_i = CullIndex(List=ln_11, Indices=-1, Wrap=True)
cull_i_2 = CullIndex(List=ln_12, Indices=-1, Wrap=True)
cull_i_3 = CullIndex(List=ln_13, Indices=-1, Wrap=True)
midpt = CurveMiddle(Curve=flatten(cull_i))
Z_24 = UnitZ(Factor=Slider(5.6, range=-10..20))
Z_25 = UnitZ(Factor=Slider(2.53, range=0..10))

# ---- group: Sorting Cores List
midpt_2 = CurveMiddle(Curve=dispdexs_2.NotI)
midpt_3 = CurveMiddle(Curve=dispdexs.NotI)  # -> graft(Midpoint)
dist_2 = Distance(PointA=midpt_3, PointB=midpt_2)
sort_3 = SortList(Keys=dist_2, ValuesA=dispdexs_2.NotI)  # -> Keys, ValuesA
item_24 = ListItem(List=sort_3.ValuesA, Index=0, Wrap=True)  # -> flatten(Item)

midpt_4 = CurveMiddle(Curve=dispdexs_2.AtI)
midpt_5 = CurveMiddle(Curve=flatten_2)  # -> graft(Midpoint)
dist_3 = Distance(PointA=midpt_5, PointB=midpt_4)
sort_4 = SortList(Keys=dist_3, ValuesA=dispdexs_2.AtI)  # -> Keys, ValuesA
item_25 = ListItem(List=sort_4.ValuesA, Index=0, Wrap=True)  # -> flatten(Item)

# ---- group: Anchors (Perimeter)
pt_13 = Point(flatten([divide_2.Points, divide_3.Points]))

# ----
midpt_6 = CurveMiddle(Curve=flatten(cull_i_3))

toggle_7 = GroupToggle(ToggleActive=True, ToggleVisible=False)  # disabled
# Roof (Lower Layer)
cps_3 = ClosestPoints(Point=pt_10, Cloud=item_9, Count="8")  # -> ClosestPoint, CPIndex, Distance
crv_cp_5 = CurveClosestPoint(Point=cps_3.ClosestPoint, Curve=item_12)  # -> Point, Parameter, Distance
avr_3 = Average(Input=crv_cp_5.Point)
cir_3 = Circle(Plane=avr_3, Radius=1)
alongcrv_3 = SortAlongCurve(Points=crv_cp_5.Point, Curve=cir_3)  # -> Points, Indices
vec2pt_2 = Vector2Pt(PointA=alongcrv_3.Points, PointB=avr_3, Unitize=False)  # -> Vector, Length
shatter_2 = Shatter(Curve=item_12, Parameters=flatten(crv_cp_5.Parameter))
amp_5 = Amplitude(Vector=vec2pt_2.Vector, Amplitude=Slider(6.5, range=0..20))
move_21 = Move(Geometry=alongcrv_3.Points, Motion=amp_5)  # -> Geometry, Transform
ln_14 = Line(StartPoint=alongcrv_3.Points, EndPoint=move_21.Geometry)
panel_23 = Panel("""2
4""")
panel_24 = Panel("""0
6""")
panel_25 = Panel("""7
15
21
5
23
31""")
end_3 = EndPoints(Curve=ln_14)  # -> Start, End
entwine_2 = Entwine(Branch00="0", Branch01=panel_23, Branch02=panel_24, Branch03="4", FlattenInputs=True)
dispdexs_3 = DispatchIndices(List=shatter_2, Indices=panel_25)  # -> AtI, NotI
shift_7 = ShiftList(List=end_3.End, Shift=1, Wrap=True)
ln_15 = Line(StartPoint=end_3.End, EndPoint=shift_7)
number_slider_17 = Slider(12, range=0..100)
partition_3 = PartitionList(List=dispdexs_3.AtI, Size="2")
end_4 = EndPoints(Curve=partition_3)  # -> Start, End
dispdexs_4 = DispatchIndices(List=ln_15, Indices=entwine_2)  # -> flatten(AtI), flatten(NotI)
shift_8 = ShiftList(List=end_4.End, Shift=1, Wrap=True)
ln_16 = Line(StartPoint=end_4.Start, EndPoint=shift_8)
divide_6 = DivideCurve(Curve=ln_14, Count=number_slider_17, Kinks=False)  # -> Points, Tangents, Parameters
flatten_3 = FlattenTree(Tree=ln_16, Path="{0}")
divide_7 = DivideCurve(Curve=dispdexs_3.NotI, Count=number_slider_17, Kinks=False)  # -> Points, Tangents, Parameters
divide_8 = DivideCurve(Curve=partition_3, Count=number_slider_17, Kinks=False)  # -> Points, Tangents, Parameters
divide_9 = DivideCurve(Curve=ln_16, Count=number_slider_17, Kinks=False)  # -> Points, Tangents, Parameters
bang_3 = ExplodeTree(Data=simplify(divide_8.Points))  # -> Branch0, Branch1, Branch2, Branch3, Branch4, Branch5
rev_5 = ReverseList(List=bang_3.Branch1)
rev_6 = ReverseList(List=bang_3.Branch3)
rev_7 = ReverseList(List=bang_3.Branch5)
ln_17 = Line(StartPoint=bang_3.Branch0, EndPoint=rev_5)
ln_18 = Line(StartPoint=bang_3.Branch2, EndPoint=rev_6)
ln_19 = Line(StartPoint=bang_3.Branch4, EndPoint=rev_7)
divide_10 = DivideCurve(Curve=[ln_17, ln_18, ln_19], Count=number_slider_17, Kinks=False)  # -> Points, Tangents, Parameters
addition_2 = Addition(A=number_slider_17, B="1")
trim_5 = TrimTree(Tree=divide_10.Points, Depth=1)
frompoints_2 = MeshFromPoints(Points=trim_5, UDirection=addition_2, VDirection=addition_2)
shift_9 = ShiftList(List=divide_6.Points, Shift=1, Wrap=False)
shift_10 = ShiftList(List=divide_9.Points, Shift=1, Wrap=False)
shift_11 = ShiftList(List=divide_10.Points, Shift=1, Wrap=True)
ln_20 = Line(StartPoint=divide_6.Points, EndPoint=shift_9)
ln_21 = Line(StartPoint=divide_9.Points, EndPoint=shift_10)
ln_22 = Line(StartPoint=divide_10.Points, EndPoint=shift_11)
cull_i_4 = CullIndex(List=ln_20, Indices=-1, Wrap=True)
cull_i_5 = CullIndex(List=ln_21, Indices=-1, Wrap=True)
cull_i_6 = CullIndex(List=ln_22, Indices=-1, Wrap=True)
midpt_7 = CurveMiddle(Curve=flatten(cull_i_4))
Z_26 = UnitZ(Factor=Slider(-5.67, range=-10..5))
Z_27 = UnitZ(Factor=Slider(4, range=0..10))

# ---- group: Sorting Cores List
midpt_8 = CurveMiddle(Curve=dispdexs_4.NotI)
midpt_9 = CurveMiddle(Curve=dispdexs_3.NotI)  # -> graft(Midpoint)
dist_4 = Distance(PointA=midpt_9, PointB=midpt_8)
sort_5 = SortList(Keys=dist_4, ValuesA=dispdexs_4.NotI)  # -> Keys, ValuesA
item_26 = ListItem(List=sort_5.ValuesA, Index=0, Wrap=True)  # -> flatten(Item)

midpt_10 = CurveMiddle(Curve=dispdexs_4.AtI)
midpt_11 = CurveMiddle(Curve=flatten_3)  # -> graft(Midpoint)
dist_5 = Distance(PointA=midpt_11, PointB=midpt_10)
sort_6 = SortList(Keys=dist_5, ValuesA=dispdexs_4.AtI)  # -> Keys, ValuesA
item_27 = ListItem(List=sort_6.ValuesA, Index=0, Wrap=True)  # -> flatten(Item)

# ---- group: Anchors (Perimeter)
pt_14 = Point(flatten([divide_7.Points, divide_8.Points]))

# ----
midpt_12 = CurveMiddle(Curve=flatten(cull_i_6))

divide_11 = DivideCurve(Curve=item_24, Count=number_slider_16, Kinks=False)  # -> Points, Tangents, Parameters
divide_12 = DivideCurve(Curve=item_25, Count=number_slider_16, Kinks=False)  # -> Points, Tangents, Parameters
ln_23 = Line(StartPoint=divide_11.Points, EndPoint=divide_2.Points)
ln_24 = Line(StartPoint=divide_4.Points, EndPoint=divide_12.Points)
divide_13 = DivideCurve(Curve=ln_23, Count=number_slider_16, Kinks=False)  # -> Points, Tangents, Parameters
divide_14 = DivideCurve(Curve=ln_24, Count=number_slider_16, Kinks=False)  # -> Points, Tangents, Parameters
trim_6 = TrimTree(Tree=divide_14.Points, Depth=1)
trim_7 = TrimTree(Tree=divide_13.Points, Depth=1)
frompoints_3 = MeshFromPoints(Points=trim_6, UDirection=addition, VDirection=addition)
frompoints_4 = MeshFromPoints(Points=trim_7, UDirection=addition, VDirection=addition)
flip = MeshFlip(Mesh=frompoints_4)
duppt = RemoveDuplicatePts(Points=pt_13, Tolerance=0.01)

# ---- group: Anchors (Center)
pt_15 = Point(flatten([divide_11.Points, divide_12.Points]))

# ----
merge_8 = Merge(Data1=flatten(flip), Data2=flatten(frompoints_3), Data3=flatten(frompoints))

divide_15 = DivideCurve(Curve=item_26, Count=number_slider_17, Kinks=False)  # -> Points, Tangents, Parameters
divide_16 = DivideCurve(Curve=item_27, Count=number_slider_17, Kinks=False)  # -> Points, Tangents, Parameters
ln_25 = Line(StartPoint=divide_15.Points, EndPoint=divide_7.Points)
ln_26 = Line(StartPoint=divide_9.Points, EndPoint=divide_16.Points)
divide_17 = DivideCurve(Curve=ln_25, Count=number_slider_17, Kinks=False)  # -> Points, Tangents, Parameters
divide_18 = DivideCurve(Curve=ln_26, Count=number_slider_17, Kinks=False)  # -> Points, Tangents, Parameters
trim_8 = TrimTree(Tree=divide_18.Points, Depth=1)
trim_9 = TrimTree(Tree=divide_17.Points, Depth=1)
frompoints_5 = MeshFromPoints(Points=trim_8, UDirection=addition_2, VDirection=addition_2)
frompoints_6 = MeshFromPoints(Points=trim_9, UDirection=addition_2, VDirection=addition_2)
flip_2 = MeshFlip(Mesh=frompoints_6)
duppt_2 = RemoveDuplicatePts(Points=pt_14, Tolerance=0.01)

# ---- group: Anchors (Center)
pt_16 = Point(flatten([divide_15.Points, divide_16.Points]))

# ----
merge_9 = Merge(Data1=flatten(flip_2), Data2=flatten(frompoints_5), Data3=flatten(frompoints_2))

duppt_3 = RemoveDuplicatePts(Points=pt_15, Tolerance=0.01)
mjoin = MeshJoin(Meshes=merge_8)
weldvertices = MeshWeldVertices(Mesh=mjoin, Tolerance=0.005)  # -> RuntimeMessage, Mesh
medges_4 = MeshEdges(Mesh=weldvertices.Mesh)  # -> NakedEdges, InteriorEdges, NonManifoldEdges
demesh = DeconstructMesh(Mesh=weldvertices.Mesh)  # -> Vertices, Faces, Colours, Normals
cp = ClosestPoint(Point=duppt_3, Cloud=demesh.Vertices)  # -> ClosestPoint, CPIndex, Distance
cp_2 = ClosestPoint(Point=duppt, Cloud=demesh.Vertices)  # -> ClosestPoint, CPIndex, Distance
midpt_13 = CurveMiddle(Curve=medges_4.InteriorEdges)
cp_3 = ClosestPoint(Point=midpt, Cloud=midpt_13)  # -> ClosestPoint, CPIndex, Distance
merge_10 = Merge(Data1=cp_2.CPIndex, Data2=cp.CPIndex)
cull_i_7 = CullIndex(List=demesh.Vertices, Indices=merge_10, Wrap=True)
dispdexs_5 = DispatchIndices(List=medges_4.InteriorEdges, Indices=cp_3.CPIndex)  # -> AtI, NotI
project_10 = ProjectPoint(Point=cp.ClosestPoint, Direction=Vector(0, 0, -1), Geometry=srf)  # -> Point, Index
line = Line(dispdexs_5.AtI)
move_22 = Move(Geometry=project_10.Point, Motion=Z_24)  # -> Geometry, Transform
length_line = LengthLine(Line=dispdexs_5.AtI, Length=Slider(0, range=0..1), Strength=Slider(75, range=0..100))
anchor = Anchor(Point=cp_2.ClosestPoint, Strength=1000000)
anchor_2 = Anchor(Point=cp.ClosestPoint, Target=move_22.Geometry, Strength=1000000)
length_line_2 = LengthLine(Line=dispdexs_5.NotI, Length=Slider(0, range=0..1), Strength=Slider(20, range=0..100))
load = Load(Point=cull_i_7, ForceVector=Z_25, Weighting=1)
show = Show(G=medges_4.InteriorEdges)  # disabled

midpt_14 = CurveMiddle(Curve=medges_4.InteriorEdges)
cp_4 = ClosestPoint(Point=midpt_6, Cloud=midpt_14)  # -> ClosestPoint, CPIndex, Distance
dispdexs_6 = DispatchIndices(List=medges_4.InteriorEdges, Indices=cp_4.CPIndex)  # -> AtI, NotI
line_2 = Line(dispdexs_6.AtI)
join_16 = JoinCurves(Curves=dispdexs_5.AtI, Preserve=False)
join_17 = JoinCurves(Curves=dispdexs_6.AtI, Preserve=False)
length_line_3 = LengthLine(Line=dispdexs_6.AtI, Length=Slider(0, range=0..1), Strength=Slider(40, range=0..100))
show_2 = Show(G=weldvertices.Mesh)

show_3 = Show(G=join_16)
show_4 = Show(G=join_17)
entwine_3 = Entwine(
    Branch0X=show_3,
    Branch1X=show_2,
    Branch2X=show_4,
    Branch3X=length_line,
    Branch4X=length_line_3,
    Branch5X=length_line_2,
    Branch6X=load,
    Branch7X=anchor,
    Branch8X=anchor_2,
    FlattenInputs=False)
bouncysolver = BouncySolver(GoalObjects=entwine_3, Reset=Button(), Threshold=1e-15, Tolerance=0.0001, Damping=0.99, Iterations=10, On=Toggle(False))  # -> I, V, O

bang_4 = ExplodeTree(Data=entwine_3)  # -> _0000, Branch1, _2000, Branch3, Branch4, Branch5, _6000, Branch7, Branch8
end_5 = EndPoints(Curve=join_16)  # -> Start, End

lng = ListLength(List=bang_4._0000)
dom_4 = ConstructDomain(DomainStart="0", DomainEnd=expr("x-1", lng))
range = Range(Domain=dom_4, Steps=expr("x-1", lng))
item_28 = ListItem(List=bouncysolver.O, Index=range, Wrap=True)

lng_2 = ListLength(List=bang_4.Branch1)
ma = MassAddition(Input=flatten([lng, lng_2]))  # -> Result, PartialResults
item_29 = ListItem(List=bouncysolver.O, Index=expr("x-1", ma.Result), Wrap=True)

ln_27 = Line(StartPoint=end_5.Start, EndPoint=end_5.End)
midpt_15 = CurveMiddle(Curve=ln_27)
move_23 = Move(Geometry=midpt_15, Motion=Z_17)  # -> Geometry, Transform
lnpt = LinePt(Line=ln_27, Point=move_23.Geometry)
line_3 = Line(bouncysolver.O)
end_6 = EndPoints(Curve=item_28)  # -> Start, End
move_24 = Move(Geometry=line_3, Motion=Z_18)  # -> Geometry, Transform; disabled
ln_28 = Line(StartPoint=end_6.Start, EndPoint=end_6.End)
mesh_8 = Mesh(item_29)
midpt_16 = CurveMiddle(Curve=ln_28)
previewlw_5 = CustomPreviewLineweights(Geometry=[line_3, move_24.Geometry], Shader=ColourSwatch(SwatchColor=RGB(0, 0, 0)), Absolute=False)
disc_9 = Discontinuity(Curve=item_28, Level=1)  # -> Points, Parameters
move_25 = Move(Geometry=midpt_16, Motion=Z_20)  # -> Geometry, Transform
intcrv_2 = Interpolate(Vertices=disc_9.Points, Degree=3, Periodic=False, KnotStyle=1)  # -> flatten(Curve), Length, Domain
preview_10 = CustomPreview(Geometry=mesh_8, Material=ColourSwatch(SwatchColor=RGB(135, 121, 88)))
lnpt_2 = LinePt(Line=ln_28, Point=move_25.Geometry)
offset_8 = OffsetCurve(Curve=intcrv_2.Curve, Distance=Slider(-0.3, range=-1..1), Plane=lnpt_2, Corners=1)
offset_9 = OffsetCurve(Curve=intcrv_2.Curve, Distance=Slider(-0.02, range=-1..1), Plane=lnpt_2, Corners=1)
entwine_4 = Entwine(Branch00=flatten(offset_9), Branch01=flatten(offset_8), FlattenInputs=True)
flip_3 = FlipMatrix(Data=entwine_4)
loft_2 = Loft(Curves=flip_3, Options={Adjust=False, Closed=False, LoftEnds=0, LoftSimp=0, LoftType=0, Rebuild=200, Refit=8.0001})  # -> flatten(Loft)
offsrf_4 = OffsetSurface(Surface=loft_2, Distance="0.025", BothSides=neg_2, CreateSolid=True)

duppt_4 = RemoveDuplicatePts(Points=pt_16, Tolerance=0.01)
mjoin_2 = MeshJoin(Meshes=merge_9)
weldvertices_2 = MeshWeldVertices(Mesh=mjoin_2, Tolerance=0.005)  # -> RuntimeMessage, Mesh
medges_5 = MeshEdges(Mesh=weldvertices_2.Mesh)  # -> NakedEdges, InteriorEdges, NonManifoldEdges
demesh_2 = DeconstructMesh(Mesh=weldvertices_2.Mesh)  # -> Vertices, Faces, Colours, Normals
cp_5 = ClosestPoint(Point=duppt_4, Cloud=demesh_2.Vertices)  # -> ClosestPoint, CPIndex, Distance
cp_6 = ClosestPoint(Point=duppt_2, Cloud=demesh_2.Vertices)  # -> ClosestPoint, CPIndex, Distance
midpt_17 = CurveMiddle(Curve=medges_5.InteriorEdges)
cp_7 = ClosestPoint(Point=midpt_7, Cloud=midpt_17)  # -> ClosestPoint, CPIndex, Distance
merge_11 = Merge(Data1=cp_6.CPIndex, Data2=cp_5.CPIndex)
cull_i_8 = CullIndex(List=demesh_2.Vertices, Indices=merge_11, Wrap=True)
move_26 = Move(Geometry=cp_5.ClosestPoint, Motion=Z_26)  # -> Geometry, Transform
dispdexs_7 = DispatchIndices(List=medges_5.InteriorEdges, Indices=cp_7.CPIndex)  # -> AtI, NotI
project_11 = ProjectPoint(Point=cp_5.ClosestPoint, Direction=Vector(0, 0, -1), Geometry=srf)  # -> Point, Index
line_4 = Line(dispdexs_7.AtI)
anchor_3 = Anchor(Point=cp_6.ClosestPoint, Strength=1000000)
anchor_4 = Anchor(Point=cp_5.ClosestPoint, Target=project_11.Point, Strength=1000000)
length_line_4 = LengthLine(Line=dispdexs_7.NotI, Length=Slider(0, range=0..1), Strength=Slider(20, range=0..100))
load_2 = Load(Point=cull_i_8, ForceVector=Z_27, Weighting=1)
show_5 = Show(G=medges_5.InteriorEdges)

midpt_18 = CurveMiddle(Curve=medges_5.InteriorEdges)
cp_8 = ClosestPoint(Point=midpt_12, Cloud=midpt_18)  # -> ClosestPoint, CPIndex, Distance
dispdexs_8 = DispatchIndices(List=medges_5.InteriorEdges, Indices=cp_8.CPIndex)  # -> AtI, NotI
line_5 = Line(dispdexs_8.AtI)
join_18 = JoinCurves(Curves=dispdexs_7.AtI, Preserve=False)
join_19 = JoinCurves(Curves=dispdexs_8.AtI, Preserve=False)
show_6 = Show(G=weldvertices_2.Mesh)

length_line_5 = LengthLine(Line=[dispdexs_7.AtI, dispdexs_8.AtI], Length=Slider(0, range=0..1), Strength=Slider(66, range=0..100))
show_7 = Show(G=join_18)
show_8 = Show(G=join_19)
entwine_5 = Entwine(
    Branch0X=show_7,
    Branch1X=show_6,
    Branch2X=show_5,
    Branch3X=show_8,
    Branch4X=length_line_5,
    Branch5X=length_line_4,
    Branch6X=load_2,
    Branch7X=anchor_3,
    Branch8X=anchor_4,
    FlattenInputs=False)
bouncysolver_2 = BouncySolver(GoalObjects=entwine_5, Reset=Button(), Threshold=1e-15, Tolerance=0.0001, Damping=0.99, Iterations=10, On=Toggle(False))  # -> I, V, O

bang_5 = ExplodeTree(Data=entwine_5)  # -> _0000, Branch1, Branch2, _3000, Branch4, Branch5, _6000, Branch7, Branch8

lng_3 = ListLength(List=bang_5._0000)
dom_5 = ConstructDomain(DomainStart="0", DomainEnd=expr("x-1", lng_3))
range_2 = Range(Domain=dom_5, Steps=expr("x-1", lng_3))
item_30 = ListItem(List=bouncysolver_2.O, Index=range_2, Wrap=True)

lng_4 = ListLength(List=bang_5.Branch1)
ma_2 = MassAddition(Input=flatten([lng_3, lng_4]))  # -> Result, PartialResults
item_31 = ListItem(List=bouncysolver_2.O, Index=expr("x-1", ma_2.Result), Wrap=True)

line_6 = Line(bouncysolver_2.O)
move_27 = Move(Geometry=line_6, Motion=Z_19)  # -> Geometry, Transform; disabled
end_7 = EndPoints(Curve=item_30)  # -> Start, End
mesh_9 = Mesh(item_31)
ln_29 = Line(StartPoint=end_7.Start, EndPoint=end_7.End)
medges_6 = MeshEdges(Mesh=mesh_9)  # -> NakedEdges, InteriorEdges, NonManifoldEdges
previewlw_6 = CustomPreviewLineweights(Geometry=[line_6, move_27.Geometry], Shader=ColourSwatch(SwatchColor=RGB(0, 0, 0)), Absolute=False)
midpt_19 = CurveMiddle(Curve=ln_29)
disc_10 = Discontinuity(Curve=item_30, Level=1)  # -> Points, Parameters
preview_11 = CustomPreview(Geometry=mesh_9, Material=ColourSwatch(SwatchColor=RGB(88, 108, 135)))
move_28 = Move(Geometry=midpt_19, Motion=Z_21)  # -> Geometry, Transform
intcrv_3 = Interpolate(Vertices=disc_10.Points, Degree=3, Periodic=False, KnotStyle=1)  # -> flatten(Curve), Length, Domain
lnpt_3 = LinePt(Line=ln_29, Point=move_28.Geometry)
offset_10 = OffsetCurve(Curve=intcrv_3.Curve, Distance=Slider(0.3, range=-1..1), Plane=lnpt_3, Corners=1)
offset_11 = OffsetCurve(Curve=intcrv_3.Curve, Distance=Slider(0.05, range=-1..1), Plane=lnpt_3, Corners=1)
entwine_6 = Entwine(Branch00=flatten(offset_11), Branch01=flatten(offset_10), FlattenInputs=True)
flip_4 = FlipMatrix(Data=entwine_6)
loft_3 = Loft(Curves=flip_4, Options={Adjust=False, Closed=False, LoftEnds=0, LoftSimp=0, LoftType=0, Rebuild=200, Refit=8.0001})  # -> flatten(Loft)
offsrf_5 = OffsetSurface(Surface=loft_3, Distance="0.025", BothSides=neg_3, CreateSolid=True)
