# Grasshopper definition Unit_gh.gh (Grasshopper 1.0.7)
# plug-ins: Kangaroo2 Components, Human, Weaverbird, Rhino.Inside for Autodesk Revit, Bifocals, ShapeDiverForGrasshopper, MeshEdit Components

sddp = ShapeDiverDocumentPayload({AbsoluteTolerance=0, AngleTolerance=0, DistanceDisplayPrecision=0, GltfVersion="Gltf2", GrasshopperVersion="1.0.0007", InputGroups="{}", OutputGroups="{}", RelativeTolerance=0, RhinoVersion="7.29.23107.3001", UnitSystem=0, VersionCreated="1.16.0.0", VersionSaved="1.14.0.0"})

# ----
# input side length!
# exterior face
# OCTOGON
number_slider = Slider(8, range=0..10)
pi = Pi(Factor=1)
number_slider_2 = Slider(3, range=0..10)
division = Division(A=pi, B=number_slider)
tan = Tangent(Value=division)
multiplication = Multiplication(A="2", B=tan)
division_2 = Division(A=number_slider_2, B=multiplication)
polygon = Polygon(Plane=PlaneXY(0, 0, 0), Radius=division_2, Segments=number_slider, FilletRadius=0)  # -> Polygon, Length
pt = Point(Point(4185.194014, 9214.115731, 0))
area = Area(Geometry=polygon.Polygon)  # -> Area, Centroid
orient = Orient(Geometry=polygon.Polygon, Source=area.Centroid, Target=pt)  # -> Geometry, Transform
Z = UnitZ(Factor=number_slider_2)
extr = Extrude(Base=polygon.Polygon, Direction=Z)

# ----
# input side length!
number_slider_3 = Slider(2.5, range=0..10)

# ----
# interior face
division_3 = Division(A=number_slider_3, B=multiplication)
polygon_2 = Polygon(Plane=PlaneXY(0, 0, 0), Radius=division_3, Segments=number_slider, FilletRadius=0)  # -> Polygon, Length
area_2 = Area(Geometry=polygon_2.Polygon)  # -> Area, Centroid
Z_2 = UnitZ(Factor=number_slider_3)
extr_2 = Extrude(Base=polygon_2.Polygon, Direction=Z_2)

cap = CapHoles(Brep=extr_2)
debrep = DeconstructBrep(Brep=cap)  # -> Faces, Edges, Vertices
debrep_2 = DeconstructBrep(Brep=debrep.Faces)  # -> Faces, Edges, Vertices
join = JoinCurves(Curves=debrep_2.Edges, Preserve=False)  # -> flatten(Curves)

# ----
# horizontal faces
# vertical faces
pcen = PolygonCenter(Polyline=join)  # -> CenterV, CenterE, CenterA
pdecon = Deconstruct(Point=pcen.CenterV)  # -> XComponent, YComponent, ZComponent
ma = MassAddition(Input=pdecon.ZComponent)  # -> Result, PartialResults
lng = ListLength(List=pdecon.ZComponent)
division_4 = Division(A=ma.Result, B=lng)
similar = Similarity(FirstNumber=pdecon.ZComponent, SecondNumber=division_4, Threshold="0.1")  # -> Similarity, AbsoluteDifference
dispatch = Dispatch(List=join, DispatchPattern=similar.Similarity)  # -> ListA, ListB
crv = Curve(dispatch.ListA)

item = ListItem(List=crv, Index=0, Wrap=True)  # -> Item, Item1, Item2, Item3, Item4, Item5, Item6, Item7
merge = Merge(Data1=item.Item4, Data2=item.Item5, Data3=item.Item6, Data4=item.Item7)
merge_2 = Merge(Data1=item.Item, Data2=item.Item1, Data3=item.Item2, Data4=item.Item3)
crv_2 = Curve(dispatch.ListB)
item_2 = ListItem(List=merge_2, Index=0, Wrap=True)  # -> Item, Item1, Item2, Item3
length = Slider(0.43, range=0..1)
# limits!
offset = Slider(0.37, range=0..1)
crv_3 = Curve([item_2.Item, item_2.Item3])
crv_4 = Curve([item_2.Item1, item_2.Item2])
# INSIDE
boundary = BoundarySurfaces(Edges=crv_3)

# ----
# points dont match,
# looks cool tho
# type 3 upper and lower
cluster = Cluster(F=length, A=offset, relay=crv_2)
crv_5 = Curve(graft(crv_2))
crv_6 = Curve(graft(cluster))
loft = Loft(Curves=[crv_5, crv_6], Options={Adjust=False, Closed=False, LoftEnds=0, LoftSimp=0, LoftType=0, Rebuild=10, Refit=0.01})  # -> flatten(Loft)
boundary_2 = BoundarySurfaces(Edges=crv_6)  # disabled

# ----
# limits!
offset_2 = Slider(0, range=0..0.55)
length_2 = Slider(0.84, range=0..1)

# ----
# limits!
length_3 = Slider(0.47, range=0..1)
offset_3 = Slider(0.31, range=0..1)

# ----
# circulation
offset_4 = Slider(0.55, range=0..0.55)
length_4 = Slider(0.9, range=0..1)
debrep_3 = DeconstructBrep(Brep=boundary)  # -> Faces, Edges, Vertices
join_2 = JoinCurves(Curves=debrep_3.Edges, Preserve=False)
disc = Discontinuity(Curve=join_2, Level=1)  # -> Points, Parameters
area_3 = Area(Geometry=boundary)  # -> Area, Centroid
shift = ShiftList(List=disc.Points, Shift=Slider(5, range=0..10), Wrap=True)
pline = PolyLine(Vertices=shift, Closed=True)
evalsrf = EvaluateSurface(Surface=reparameterize(boundary), Point=area_3.Centroid)  # -> Point, Normal, UDirection, VDirection, Frame
scale = Scale(Geometry=flatten(pline), Center=area_3.Centroid, Factor=length_4)  # -> Geometry, Transform
amp = Amplitude(Vector=evalsrf.Normal, Amplitude=offset_4)
move = Move(Geometry=scale.Geometry, Motion=amp)  # -> Geometry, Transform
debrep_4 = DeconstructBrep(Brep=move.Geometry)  # -> Faces, Edges, Vertices
divide = DivideDomain²(Domain=debrep_4.Faces, UCount="1", VCount="2")
subsrf = Isotrim(Surface=debrep_4.Faces, Domain=divide)
item_3 = ListItem(List=subsrf, Index=0, Wrap=True)  # -> Item, Item1
debrep_5 = DeconstructBrep(Brep=item_3.Item1)  # -> Faces, Edges, Vertices
join_3 = JoinCurves(Curves=debrep_5.Edges, Preserve=False)
disc_2 = Discontinuity(Curve=join_3, Level=1)  # -> Points, Parameters
disc_3 = Discontinuity(Curve=pline, Level=1)  # -> Points, Parameters
shift_2 = ShiftList(List=disc_2.Points, Shift=1, Wrap=True)
pline_2 = PolyLine(Vertices=disc_3.Points, Closed=True)  # -> simplify(Polyline)
pline_3 = PolyLine(Vertices=shift_2, Closed=True)  # -> simplify(Polyline)
loft_2 = Loft(
    Curves=[pline_3, pline_2],
    Options={Adjust=False, Closed=False, LoftEnds=0, LoftSimp=0, LoftType=0, Rebuild=10, Refit=0.01})  # -> flatten(Loft)

boundary_3 = BoundarySurfaces(Edges=crv_4)
area_4 = Area(Geometry=boundary_3)  # -> Area, Centroid
evalsrf_2 = EvaluateSurface(Surface=reparameterize(boundary_3), Point=area_4.Centroid)  # -> Point, Normal, UDirection, VDirection, Frame
scale_2 = Scale(Geometry=crv_4, Center=area_4.Centroid, Factor=length_2)  # -> Geometry, Transform
amp_2 = Amplitude(Vector=evalsrf_2.Normal, Amplitude=offset_2)
move_2 = Move(Geometry=scale_2.Geometry, Motion=amp_2)  # -> Geometry, Transform
crv_7 = Curve(graft(crv_4))
crv_8 = Curve(graft(move_2.Geometry))
loft_3 = Loft(Curves=[crv_8, crv_7], Options={Adjust=False, Closed=False, LoftEnds=0, LoftSimp=0, LoftType=0, Rebuild=10, Refit=0.01})  # -> flatten(Loft)

# ----
# OUTSIDE
cluster_2 = Cluster_2(G=merge, F=length_3, A_2=Slider(0, range=0..100), A=offset_3, E=merge)
crv_9 = Curve(graft(cluster_2))
crv_10 = Curve(graft(merge))
loft_4 = Loft(Curves=[crv_10, crv_9], Options={Adjust=False, Closed=False, LoftEnds=0, LoftSimp=0, LoftType=0, Rebuild=10, Refit=0.01})  # -> flatten(Loft)
boundary_4 = BoundarySurfaces(Edges=crv_9)  # -> flatten(Surfaces)

number_slider_4 = Slider(21602, range=10000..30000)  # disabled
mesh = Mesh(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)  # disabled
srf = Surface(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)  # disabled
pt_2 = Point(Point(-10541.30868, 12500.40471, -12653.74845))  # disabled
xy = XYPlane(Origin=Point(0, 0, 0))  # disabled
faceb = FaceBoundaries(Mesh=mesh)  # disabled
explode = Explode(Curve=faceb, Recursive=True)  # -> Segments, Vertices; disabled
sph = Sphere(Base=pt_2, Radius=number_slider_4)  # disabled
demesh = DeconstructMesh(Mesh=mesh)  # -> Vertices, Faces, Colours, Normals; disabled
avr = Average(Input=explode.Vertices)  # disabled
lng_2 = ListLength(List=explode.Vertices)  # disabled
number = Number(expr("x-1", lng_2))  # disabled
sec = BrepPlane(Brep=sph, Plane=xy)  # -> Curves, Points; disabled
srf_cp = SurfaceClosestPoint(Point=avr, Surface=reparameterize(srf))  # -> Point, UVPoint, Distance; disabled
project = Project(Geometry=demesh.Vertices, Plane=xy)  # -> Geometry, Transform; disabled
cull_i = CullIndex(List=explode.Vertices, Indices=number, Wrap=True)  # disabled
incurve = PointInCurve(Point=project.Geometry, Curve=sec.Curves)  # -> Relationship, Point; disabled
pdecon_2 = Deconstruct(Point=srf_cp.UVPoint)  # -> XComponent, YComponent, ZComponent; disabled
component_families = ComponentFamiliesPicker(<component families picker referenced from the Revit model>, SearchPattern="adaptive")  # disabled
panel = Panel("1")  # disabled
multiplication_2 = Multiplication(A=pdecon_2.XComponent, B=pdecon_2.YComponent)  # disabled
bnd = Bounds(Numbers=flatten(multiplication_2))  # disabled
dedomain = DeconstructDomain(Domain=bnd)  # -> Start, End; disabled
smaller = SmallerThan(FirstNumber=incurve.Relationship, SecondNumber=panel)  # -> SmallerThan, OrEqualTo; disabled
dispatch_2 = Dispatch(List=demesh.Vertices, DispatchPattern=smaller.SmallerThan)  # -> ListA, ListB; disabled
dispatch_3 = Dispatch(List=project.Geometry, DispatchPattern=smaller.SmallerThan)  # -> ListA, ListB; disabled

# ----
# op B no divisions
number_slider_5 = Slider(0.66, range=0..1)  # disabled
cluster_3 = Cluster_3(F=number_slider_5, L=crv_4)  # -> crv_3, crv_4; disabled
loft_5 = Loft(
    Curves=[cluster_3.crv_3, cluster_3.crv_4],
    Options={Adjust=False, Closed=False, LoftEnds=0, LoftSimp=0, LoftType=0, Rebuild=10, Refit=0.01})  # -> flatten(Loft); disabled

gradient = Gradient(
    LowerLimit=dedomain.Start,
    UpperLimit=dedomain.End,
    Parameter=multiplication_2,
    stops=[0: RGB(0, 128, 0), 0.5: RGB(255, 255, 0), 1: RGB(255, 0, 0)])  # disabled
element_type_picker = ElementTypePicker(component_families)  # disabled
crv_cp = CurveClosestPoint(Point=dispatch_3.ListB, Curve=sec.Curves)  # -> Point, Parameter, Distance; disabled
panel_2 = Panel("Color ")  # disabled
vec2pt = Vector2Pt(PointA=dispatch_3.ListB, PointB=crv_cp.Point, Unitize=False)  # -> Vector, Length; disabled
vec2pt_2 = Vector2Pt(PointA=dispatch_3.ListB, PointB=dispatch_2.ListB, Unitize=False)  # -> Vector, Length; disabled
ln = Line(StartPoint=dispatch_2.ListA, EndPoint=dispatch_3.ListA)  # disabled
trigger = Trigger(Interval=-1000, TimerInterval=1000, Target=a_component)  # disabled
ln_2 = Line(StartPoint=dispatch_2.ListB, EndPoint=crv_cp.Point)  # -> flatten(Line); disabled
concat = Concatenate(FragmentA=panel_2, FragmentB=gradient)  # disabled
pl = ConstructPlane(Origin=dispatch_3.ListB, XAxis=vec2pt.Vector, YAxis=vec2pt_2.Vector)  # disabled
a_component = AddComponentAdaptive(Points=cull_i, Type=element_type_picker, TrackingMode=2)  # disabled
external_vertical = Curve(ln)  # disabled
bcx = BrepCurve(Brep=sph, Curve=ln_2)  # -> Curves, Points; disabled
preview = CustomPreview(Geometry=avr, Material=gradient)  # disabled
material = AddMaterial(Name=concat, TrackingMode=2)  # disabled
crv_cp_2 = CurveClosestPoint(Point=bcx.Points, Curve=reparameterize(graft(ln_2)))  # -> Point, Parameter, Distance; disabled
panel_3 = Panel(concat)  # disabled
graphics = MaterialGraphics(Material=material)  # -> Material, UseRenderAppearance, Color, Transparency, SurfacePatternsForegroundPattern, SurfacePatternsForegroundColor, SurfacePatternsBackgroundPattern, SurfacePatternsBackgroundColor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; disabled
item_4 = ListItem(List=crv_cp_2.Parameter, Index=0, Wrap=True)  # disabled
panel_4 = Panel("1")  # disabled
panel_5 = Panel("20000")  # disabled
panel_6 = Panel("Material")  # disabled
similar_2 = Similarity(FirstNumber=item_4, SecondNumber=panel_4, Threshold=0.1)  # -> Similarity, AbsoluteDifference; disabled
dispatch_4 = Dispatch(List=pl, DispatchPattern=flatten(similar_2.Similarity))  # -> ListA, ListB; disabled
dispatch_5 = Dispatch(List=dispatch_2.ListB, DispatchPattern=flatten(similar_2.Similarity))  # -> ListA, ListB; disabled
dispatch_6 = Dispatch(List=ln_2, DispatchPattern=flatten(similar_2.Similarity))  # -> ListA, ListB; disabled
rectangle = Rectangle(Plane=dispatch_4.ListB, XSize=panel_5, YSize=panel_5, Radius=0)  # -> Rectangle, Length; disabled
param = ElementParameter(Element=simplify(a_component), Parameter=panel_6, Value=material)  # -> Element, Value; disabled
boundary_5 = BoundarySurfaces(Edges=rectangle.Rectangle)  # disabled
external_inclined = Curve(dispatch_6.ListA)  # disabled
bbx = BrepBrep(BrepA=boundary_5, BrepB=sph)  # -> Curves, Points; disabled
tan_2 = TangentLines(Point=graft(dispatch_5.ListB), Circle=bbx.Curves)  # -> Tangent1, Tangent2; disabled
# Type 2
mesh_2 = Mesh(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)
# Type 1
mesh_3 = Mesh(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)
end = EndPoints(Curve=tan_2.Tangent1)  # -> Start, End; disabled
crv_cp_3 = CurveClosestPoint(Point=end.End, Curve=bbx.Curves)  # -> Point, Parameter, Distance; disabled
shatter = Shatter(Curve=bbx.Curves, Parameters=crv_cp_3.Parameter)  # disabled
merge_3 = Merge(Data1=loft_2, Data2=loft_3, Data3=loft_4, Data4=boundary_4, Data5=loft)
panel_7 = Panel("0")  # disabled
cull_i_2 = CullIndex(List=shatter, Indices=panel_7, Wrap=True)  # disabled
join_4 = BrepJoin(Breps=merge_3)  # -> Breps, Closed
merge_4 = Merge(Data1=simplify(tan_2.Tangent1), Data2=simplify(cull_i_2))  # disabled
debrep_6 = DeconstructBrep(Brep=join_4.Breps)  # -> Faces, Edges, Vertices
join_5 = JoinCurves(Curves=merge_4, Preserve=False)  # disabled
component_families_2 = ComponentFamiliesPicker(SearchPattern="class")  # disabled
external_vertical_2 = Curve(external_vertical)  # disabled
avr_2 = Average(Input=debrep_6.Vertices)
external_curved = Curve(flatten(join_5))  # disabled
external_inclined_2 = Curve(external_inclined)  # disabled
debrep_7 = DeconstructBrep(Brep=debrep_6.Faces)  # -> Faces, Edges, Vertices
lng_3 = ListLength()
cset = CreateSet(List=flatten(lng_3))  # -> Set, Map
panel_8 = Panel("3")  # disabled
panel_9 = Panel("6")  # disabled
panel_10 = Panel(cset.Set)
panel_11 = Panel(debrep_7.Edges)
reb = RebuildCurve(Curve=external_curved, Degree=panel_8, Count=panel_9, Tangents=False)  # disabled
panel_12 = Panel(debrep_6.Faces)
element_type_picker_2 = ElementTypePicker(component_families_2)  # disabled
element_type_picker_3 = ElementTypePicker(component_families_2)  # disabled
levels = LevelsPicker(<levels picker referenced from the Revit model>)  # disabled
entwine = Entwine(Branch00=external_vertical_2, Branch01=external_inclined_2, Branch02=reb, FlattenInputs=True)  # -> simplify(Result); disabled
element_type_picker_4 = ElementTypePicker(component_families_2)  # disabled
flip = FlipCurve(Curve=entwine)  # -> Curve, Flag; disabled
component_families_3 = ComponentFamiliesPicker(<component families picker referenced from the Revit model>, SearchPattern="structural")
merge_5 = Merge(Data1=element_type_picker_4, Data2=element_type_picker_2, Data3=element_type_picker_3)  # disabled
scale_3 = Scale(Geometry=debrep_6.Edges, Center=avr_2, Factor=Slider(1, range=0.75..1.5))  # -> Geometry, Transform
triremesh = TriRemesh(Geometry=join_4.Breps, Iterations=25)  # -> Triangulation, Dual, Creases
tstat = TreeStatistics(Tree=graft(flip.Curve))  # -> Paths, Length, Count; disabled
tstat_2 = TreeStatistics(Tree=flip.Curve)  # -> Paths, Length, Count; disabled
dpath = DeconstructPath(Branch=tstat.Paths)  # disabled
dup = DuplicateData(Data=graft(tstat_2.Paths), Number=graft(tstat_2.Length), Order=True)  # disabled
item_5 = ListItem(List=dpath, Index=0, Wrap=True)  # disabled
mp = MultiPipe(
    Curves=scale_3.Geometry,
    NodeSize=Slider(0.07, range=0..0.3),
    EndOffset=1,
    StrutSize=Slider(0.36, range=0..1),
    Segment=0,
    KinkAngle=0.6,
    CubeFit=0,
    Caps=0)
item_6 = ListItem(List=merge_5, Index=item_5, Wrap=True)  # -> simplify(Item); disabled
element_type_picker_5 = ElementTypePicker(
    component_families_3,
    {"G06 structure frames 2 : G06 structure frames 2": "259cede1-da21-465f-9b38-6fb7cec222e9:663c11c7-d6fa-4a35-bc7d-2b96c24eb3a3-0005817e"}, selected="G06 structure frames 2 : G06 structure frames 2")
trigger_2 = Trigger(Interval=-1000, TimerInterval=1000, Target=s_beam)  # disabled
wbcatmullclark = WeaverbirdsCatmullClarkSubdivision(MeshCurves=triremesh.Triangulation, Level=Slider(2, range=0..10), SmoothNakedEdges=1)
len = Length(Curve=flip.Curve)  # -> flatten(Length); disabled

# ---- group: Upgraded : Add Beam
L = Level(levels)  # disabled

# ---- group: Upgraded : Add Beam / Add Beam
s_beam = AddStructuralBeam(Curve=flatten(flip.Curve), Type=flatten(item_6), TrackingMode=2)  # disabled

# ----
phase = Phase(<phase referenced from the Revit model>)

boundary_6 = BoundarySurfaces(Edges=crv_2)
cap_2 = CapHoles(Brep=join_4.Breps)
item_7 = ListItem(List=boundary_6, Index=0, Wrap=True)

panel_13 = Panel("0.2 to 1")  # disabled
previewmat = CustomPreviewMaterials(Geometry=wbcatmullclark, DiffuseColor=RGB(255, 255, 255))
previewmat_2 = CustomPreviewMaterials(Geometry=mp, DiffuseColor=RGB(255, 255, 255))
number_slider_6 = Slider(8, range=0..10)
crv_11 = Curve(scale_3.Geometry)
bnd_2 = Bounds(Numbers=len)  # disabled
remap = RemapNumbers(Value=len, Source=bnd_2, Target=panel_13)  # -> Mapped, Clipped; disabled
panel_14 = Panel("150")  # disabled
panel_15 = Panel("350")  # disabled
multiplication_3 = Multiplication(A=panel_15, B=remap.Mapped)  # disabled
multiplication_4 = Multiplication(A=panel_14, B=remap.Mapped)  # disabled
panel_16 = Panel("R")  # disabled
panel_17 = Panel("r")  # disabled
param_2 = ElementParameter(Element=s_beam, Parameter=panel_17, Value=multiplication_4)  # -> Element, Value; disabled
param_3 = ElementParameter(Element=s_beam, Parameter=panel_16, Value=multiplication_3)  # -> Element, Value; disabled

mesh_4 = Mesh(<mesh referenced from the Rhino model>)
srf_2 = Surface(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)
explode_2 = MeshExplode(Mesh=mesh_4, Interpolate=False)
demesh_2 = DeconstructMesh(Mesh=explode_2)  # -> Vertices, Faces, Colours, Normals
area_5 = Area(Geometry=explode_2)  # -> Area, Centroid
sort = SortList(Keys=demesh_2.Vertices, ValuesA=demesh_2.Vertices)  # -> Keys, ValuesA
srf_cp_2 = SurfaceClosestPoint(Point=area_5.Centroid, Surface=reparameterize(mesh_4))  # -> Point, UVPoint, Distance
component_families_4 = ComponentFamiliesPicker(<component families picker referenced from the Revit model>, SearchPattern="generic")
element_type_picker_6 = ElementTypePicker(
    component_families_4,
    {"quadMeshPanel : quadMeshPanel": "259cede1-da21-465f-9b38-6fb7cec222e9:767992d0-5ce3-406e-9628-705649cfe053-00058682"}, selected="quadMeshPanel : quadMeshPanel")
active = ActiveDocument()
trigger_3 = Trigger(Interval=1000, TimerInterval=1000, Target=[a_component_2, s_beam_2])  # disabled
a_component_2 = AddComponentAdaptive(Document=active, Points=demesh_2.Vertices, Type=element_type_picker_6, TrackingMode=2)  # -> simplify(Component)
inspect = InspectElement(Element=a_component_2)  # -> simplify(MaterialsAndFinishesPanelMaterial)
param_4 = ElementParameter(Element=a_component_2, Parameter=inspect)  # -> Element, Value
phasing = ElementPhasing(Element=param_4.Element, Created=phase)  # -> Element, Created, Demolished

meshcp = MeshClosestPoint(Point=area_5.Centroid, Mesh=mesh_4)  # -> Point, Index, Parameter

pdecon_3 = Deconstruct(Point=meshcp.Point)  # -> XComponent, YComponent, ZComponent
multiplication_5 = Multiplication(A=pdecon_3.XComponent, B=pdecon_3.YComponent)  # -> simplify(Result)
bnd_3 = Bounds(Numbers=flatten(multiplication_5))
dedomain_2 = DeconstructDomain(Domain=bnd_3)  # -> Start, End
gradient_2 = Gradient(
    LowerLimit=dedomain_2.Start,
    UpperLimit=dedomain_2.End,
    Parameter=multiplication_5,
    stops=[0: RGB(0, 128, 0), 0.5: RGB(255, 255, 0), 1: RGB(255, 0, 0)])
cset_2 = CreateSet(List=flatten(gradient_2))  # -> Set, Map
concat_2 = Concatenate(FragmentA="color ", FragmentB=cset_2.Set)
material_2 = AddMaterial(Name=concat_2, TrackingMode=2)
item_8 = ListItem(List=flatten(material_2), Index=cset_2.Map, Wrap=True)  # -> simplify(graft(Item))
graphics_2 = MaterialGraphics(Material=item_8, Color=gradient_2)  # -> simplify(Material), UseRenderAppearance, Color, Transparency, SurfacePatternsForegroundPattern, SurfacePatternsForegroundColor, CutPatternsForegroundPattern, CutPatternsForegroundColor

area_6 = Area(Geometry=mesh_4)  # -> Area, Centroid
arrpolar = PolarArray(Geometry=join_4.Breps, Plane=area_6.Centroid, Count=number_slider_6, Angle=6.283185307)  # -> Geometry, Transform
arrpolar_2 = PolarArray(Geometry=scale_3.Geometry, Plane=area_6.Centroid, Count=number_slider_6, Angle=6.283185307)  # -> Geometry, Transform
cull_i_3 = CullIndex(List=arrpolar.Geometry, Indices="0", Wrap=True)
cull_i_4 = CullIndex(List=arrpolar_2.Geometry, Indices="0", Wrap=True)
s_beam_2 = AddStructuralBeam(Curve=flatten([crv_11, cull_i_4]), Type=element_type_picker_5, TrackingMode=2)
phasing_2 = ElementPhasing(Element=s_beam_2, Created=phase)  # -> Element, Created, Demolished
b_shape = AddDirectShapeBrep(Brep=cull_i_3, TrackingMode=2)

# ==== cluster Cluster
relay = ClusterInput()
boundary = BoundarySurfaces(Edges=relay)
area = Area(Geometry=boundary)  # -> Area, Centroid
F = ClusterInput()
evalsrf = EvaluateSurface(Surface=reparameterize(boundary), Point=area.Centroid)  # -> Point, Normal, UDirection, VDirection, Frame
scale = Scale(Geometry=relay, Center=area.Centroid, Factor=F)  # -> Geometry, Transform
A = ClusterInput()
amp = Amplitude(Vector=evalsrf.Normal, Amplitude=A)
move = Move(Geometry=scale.Geometry, Motion=amp)  # -> Geometry, Transform
G = ClusterOutput(move.Geometry)

# ==== cluster Cluster_2
E = ClusterInput()
boundary = BoundarySurfaces(Edges=E)
area = Area(Geometry=boundary)  # -> Area, Centroid
G = ClusterInput()
F = ClusterInput()
evalsrf = EvaluateSurface(Surface=reparameterize(boundary), Point=area.Centroid)  # -> Point, Normal, UDirection, VDirection, Frame
scale = Scale(Geometry=G, Center=area.Centroid, Factor=F)  # -> Geometry, Transform
A = ClusterInput()
amp = Amplitude(Vector=evalsrf.Normal, Amplitude=A)
pln = Plane(evalsrf.Normal)
move = Move(Geometry=scale.Geometry, Motion=amp)  # -> Geometry, Transform
debrep = DeconstructBrep(Brep=move.Geometry)  # -> Faces, Edges, Vertices
avr = Average(Input=debrep.Vertices)  # -> flatten(ArithmeticMean)
ln = Line(StartPoint=area.Centroid, EndPoint=avr)
A_2 = ClusterInput()
rotax = RotateAxis(Geometry=move.Geometry, Angle=degrees(A_2), Axis=ln)  # -> Geometry, Transform
relay = ClusterOutput(rotax.Geometry)

# ==== cluster Cluster_3
L = ClusterInput()
item = ListItem(List=L, Index=0, Wrap=True)  # -> Item, Item1
disc = Discontinuity(Curve=item.Item, Level=1)  # -> Points, Parameters
disc_2 = Discontinuity(Curve=item.Item1, Level=1)  # -> Points, Parameters
item_2 = ListItem(List=disc.Points, Index=0, Wrap=True)  # -> Item, Item1, Item2, Item3
item_3 = ListItem(List=disc_2.Points, Index=0, Wrap=True)  # -> Item, Item1, Item2, Item3
ln = Line(StartPoint=item_2.Item, EndPoint=item_2.Item1)
midpt = CurveMiddle(Curve=ln)
merge = Merge(
    Data1=item_2.Item1,
    Data2=item_2.Item2,
    Data3=item_2.Item3,
    Data4=item_2.Item,
    Data5=item_3.Item,
    Data6=item_3.Item1,
    Data7=item_3.Item2)
pline = PolyLine(Vertices=merge, Closed=True)
F = ClusterInput()
scale = Scale(Geometry=pline, Center=midpt, Factor=F)  # -> Geometry, Transform
crv = Curve(scale.Geometry)
crv_2 = Curve(pline)
crv_3 = ClusterOutput(crv)
crv_4 = ClusterOutput(crv_2)
