# Grasshopper definition Meditation_interior_design_v1.gh (Grasshopper 1.0.7)
# plug-ins: Kangaroo2 Components, MetaHopper, Heteroptera, MeshEdit Components, ClipperComponents, Karamba3D

# AIR CYARD
# units contour
geo = Geometry([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])
# units contour
# WATER CYARD
geo_2 = Geometry([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])

# ----
# units contour
# EARTH CYARD
geo_3 = Geometry([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])

debrep = DeconstructBrep(Brep=geo_2)  # -> Faces, Edges, Vertices
debrep_2 = DeconstructBrep(Brep=geo)  # -> Faces, Edges, Vertices
debrep_3 = DeconstructBrep(Brep=geo_3)  # -> Faces, Edges, Vertices
area = Area(Geometry=debrep.Faces)  # -> Area, Centroid
area_2 = Area(Geometry=debrep_2.Faces)  # -> Area, Centroid
area_3 = Area(Geometry=debrep_3.Faces)  # -> Area, Centroid
pdecon = Deconstruct(Point=area.Centroid)  # -> XComponent, YComponent, ZComponent
pdecon_2 = Deconstruct(Point=area_2.Centroid)  # -> XComponent, YComponent, ZComponent
pdecon_3 = Deconstruct(Point=area_3.Centroid)  # -> XComponent, YComponent, ZComponent
panel = Panel(pdecon.ZComponent)
panel_2 = Panel(pdecon.ZComponent)
panel_3 = Panel(pdecon_2.ZComponent)
panel_4 = Panel(pdecon_2.ZComponent)
panel_5 = Panel(pdecon_3.ZComponent)
panel_6 = Panel(pdecon_3.ZComponent)
ma = MassAddition(Input=panel)  # -> Result, PartialResults
lng = ListLength(List=panel)
ma_2 = MassAddition(Input=panel_3)  # -> Result, PartialResults
lng_2 = ListLength(List=panel_3)
ma_3 = MassAddition(Input=panel_5)  # -> Result, PartialResults
lng_3 = ListLength(List=panel_5)
division = Division(A=ma.Result, B=lng)
division_2 = Division(A=ma_2.Result, B=lng_2)
division_3 = Division(A=ma_3.Result, B=lng_3)

# ----
# always sleect the top f
# aces and make sno sense
smaller = SmallerThan(FirstNumber=pdecon.ZComponent, SecondNumber=division)  # -> SmallerThan, OrEqualTo
larger = LargerThan(FirstNumber=pdecon.ZComponent, SecondNumber=division)  # -> LargerThan, OrEqualTo
dispatch = Dispatch(List=debrep.Faces, DispatchPattern=larger.OrEqualTo)  # -> ListA, ListB
srf = Surface(dispatch.ListB)

# ----
# remove this when solved
bnd = Bounds(Numbers=flatten(pdecon.ZComponent))
dedomain = DeconstructDomain(Domain=bnd)  # -> Start, End
subtraction = Subtraction(A=dedomain.End, B=dedomain.Start)
Z = UnitZ(Factor=subtraction)
srf_2 = Surface(dispatch.ListA)
neg = Negative(Value=Z)
move = Move(Geometry=srf_2, Motion=neg)  # -> Geometry, Transform

# ----
# always sleect the top f
# aces and make sno sense
smaller_2 = SmallerThan(FirstNumber=pdecon_2.ZComponent, SecondNumber=division_2)  # -> SmallerThan, OrEqualTo
larger_2 = LargerThan(FirstNumber=pdecon_2.ZComponent, SecondNumber=division_2)  # -> LargerThan, OrEqualTo
dispatch_2 = Dispatch(List=debrep_2.Faces, DispatchPattern=larger_2.OrEqualTo)  # -> ListA, ListB
srf_3 = Surface(dispatch_2.ListB)

# ----
# remove this when solved
bnd_2 = Bounds(Numbers=flatten(pdecon_2.ZComponent))
dedomain_2 = DeconstructDomain(Domain=bnd_2)  # -> Start, End
subtraction_2 = Subtraction(A=dedomain_2.End, B=dedomain_2.Start)
Z_2 = UnitZ(Factor=subtraction_2)
srf_4 = Surface(dispatch_2.ListA)
neg_2 = Negative(Value=Z_2)
move_2 = Move(Geometry=srf_4, Motion=neg_2)  # -> Geometry, Transform

# ----
# always sleect the top f
# aces and make sno sense
smaller_3 = SmallerThan(FirstNumber=pdecon_3.ZComponent, SecondNumber=division_3)  # -> SmallerThan, OrEqualTo
larger_3 = LargerThan(FirstNumber=pdecon_3.ZComponent, SecondNumber=division_3)  # -> LargerThan, OrEqualTo
dispatch_3 = Dispatch(List=debrep_3.Faces, DispatchPattern=larger_3.OrEqualTo)  # -> ListA, ListB
srf_5 = Surface(dispatch_3.ListB)

# ----
# remove this when solved
bnd_3 = Bounds(Numbers=flatten(pdecon_3.ZComponent))
dedomain_3 = DeconstructDomain(Domain=bnd_3)  # -> Start, End
subtraction_3 = Subtraction(A=dedomain_3.End, B=dedomain_3.Start)
Z_3 = UnitZ(Factor=subtraction_3)
srf_6 = Surface(dispatch_3.ListA)
neg_3 = Negative(Value=Z_3)
move_3 = Move(Geometry=srf_6, Motion=neg_3)  # -> Geometry, Transform

debrep_4 = DeconstructBrep(Brep=move.Geometry)  # -> Faces, Edges, Vertices
debrep_5 = DeconstructBrep(Brep=move_2.Geometry)  # -> Faces, Edges, Vertices
debrep_6 = DeconstructBrep(Brep=move_3.Geometry)  # -> Faces, Edges, Vertices
area_4 = Area(Geometry=debrep_4.Faces)  # -> Area, flatten(Centroid)
midpt = CurveMiddle(Curve=debrep_4.Edges)
area_5 = Area(Geometry=debrep_5.Faces)  # -> Area, flatten(Centroid)
midpt_2 = CurveMiddle(Curve=debrep_5.Edges)
area_6 = Area(Geometry=debrep_6.Faces)  # -> Area, flatten(Centroid)
midpt_3 = CurveMiddle(Curve=debrep_6.Edges)
avr = Average(Input=area_4.Centroid)
avr_2 = Average(Input=area_5.Centroid)
avr_3 = Average(Input=area_6.Centroid)
ln = Line(StartPoint=avr, EndPoint=midpt)
ln_2 = Line(StartPoint=avr_2, EndPoint=midpt_2)
ln_3 = Line(StartPoint=avr_3, EndPoint=midpt_3)
len = Length(Curve=ln)
len_2 = Length(Curve=ln_2)
len_3 = Length(Curve=ln_3)
smaller_4 = SmallerThan(FirstNumber=len, SecondNumber=Slider(12.13, range=10..16))  # -> SmallerThan, OrEqualTo
smaller_5 = SmallerThan(FirstNumber=len_2, SecondNumber=Slider(12.13, range=10..16))  # -> SmallerThan, OrEqualTo
smaller_6 = SmallerThan(FirstNumber=len_3, SecondNumber=Slider(12.13, range=10..16))  # -> SmallerThan, OrEqualTo
dispatch_4 = Dispatch(List=debrep_4.Edges, DispatchPattern=smaller_4.SmallerThan)  # -> ListA, ListB
dispatch_5 = Dispatch(List=debrep_5.Edges, DispatchPattern=smaller_5.SmallerThan)  # -> ListA, ListB
dispatch_6 = Dispatch(List=debrep_6.Edges, DispatchPattern=smaller_6.SmallerThan)  # -> ListA, ListB
crv = Curve(dispatch_4.ListB)

# ----
# curve
crv_2 = Curve(dispatch_4.ListA)
join = JoinCurves(Curves=flatten(crv_2), Preserve=False)

crv_3 = Curve(dispatch_5.ListB)

# ----
# curve
crv_4 = Curve(dispatch_5.ListA)

# ----
# curve
crv_5 = Curve(dispatch_6.ListA)
join_2 = JoinCurves(Curves=flatten(crv_5), Preserve=False)

crv_6 = Curve(dispatch_6.ListB)
join_3 = JoinCurves(Curves=flatten(crv_4), Preserve=False)

# ----
# MANUAL INPUT (FOR NOW)
number_slider = Slider(21, range=0..24)

# ----
# MANUAL INPUT (FOR NOW)
number_slider_2 = Slider(15, range=0..24)

# ----
# MANUAL INPUT (FOR NOW)
number_slider_3 = Slider(3, range=0..24)

# ----
# MANUAL INPUT (FOR NOW)
number_slider_4 = Slider(21, range=0..24)

debrep_7 = DeconstructBrep(Brep=join)  # -> Faces, Edges, Vertices

# ----
# center point
pcen = PolygonCenter(Polyline=join)  # -> CenterV, CenterE, CenterA

debrep_8 = DeconstructBrep(Brep=join_3)  # -> Faces, Edges, Vertices

# ----
# center point
pcen_2 = PolygonCenter(Polyline=join_3)  # -> CenterV, CenterE, CenterA

# ----
# center point
pcen_3 = PolygonCenter(Polyline=join_2)  # -> CenterV, CenterE, CenterA

# ----
# FLOOR extrusion
number_slider_5 = Slider(3, range=1..3)

debrep_9 = DeconstructBrep(Brep=join_2)  # -> Faces, Edges, Vertices
shift = ShiftList(List=debrep_7.Edges, Shift=number_slider_2, Wrap=True)
shift_2 = ShiftList(List=debrep_8.Edges, Shift=number_slider_3, Wrap=True)

# ----
# CENTER RADIUS
number_slider_6 = Slider(4, range=0..10)
pt = Point(pcen.CenterV)
circle = CircleCNR(Center=pt, Normal=Vector(0, 0, 1), Radius=number_slider_6)

# ----
# CENTER RADIUS
number_slider_7 = Slider(4, range=0..10)
pt_2 = Point(pcen_2.CenterV)
circle_2 = CircleCNR(Center=pt_2, Normal=Vector(0, 0, 1), Radius=number_slider_7)

# ----
# sorted points
midpt_4 = CurveMiddle(Curve=shift)

# ----
# sorted points
midpt_5 = CurveMiddle(Curve=shift_2)

bnd_4 = Bounds(Numbers=midpt_5)

# ----
# FLOOR
Z_4 = UnitZ(Factor=number_slider_5)
boundary = BoundarySurfaces(Edges=join_3)
neg_4 = Negative(Value=Z_4)
extr = Extrude(Base=boundary, Direction=neg_4)

# ----
# FLOOR
Z_5 = UnitZ(Factor=number_slider_5)
boundary_2 = BoundarySurfaces(Edges=join)
neg_5 = Negative(Value=Z_5)
extr_2 = Extrude(Base=boundary_2, Direction=neg_5)

shift_3 = ShiftList(List=debrep_9.Edges, Shift=number_slider_4, Wrap=True)

# ----
# CENTER RADIUS
number_slider_8 = Slider(4, range=0..10)
pt_3 = Point(pcen_3.CenterV)
circle_3 = CircleCNR(Center=pt_3, Normal=Vector(0, 0, 1), Radius=number_slider_8)

random = Random(Range=bnd_4, Number=Slider(3, range=0..10), Seed=Slider(6, range=0..10))
bnd_5 = Bounds(Numbers=midpt_4)

# ----
# sorted points
midpt_6 = CurveMiddle(Curve=shift_3)

# ----
# FLOOR
Z_6 = UnitZ(Factor=number_slider_5)
boundary_3 = BoundarySurfaces(Edges=join_2)
# PATH
neg_6 = Negative(Value=Z_6)
extr_3 = Extrude(Base=boundary_3, Direction=neg_6)

item = ListItem(List=midpt_5, Index=random, Wrap=True)
bnd_6 = Bounds(Numbers=midpt_6)
points = PointList(Points=midpt_4, Size=Slider(1, range=0..1))
points_2 = PointList(Points=midpt_5, Size=Slider(1, range=0..1))
random_2 = Random(Range=bnd_5, Number=Slider(3, range=0..10), Seed=Slider(9, range=0..10))
points_3 = PointList(Points=midpt_6, Size=Slider(1, range=0..1))
merge = Merge(Data1=pt_2, Data2=item)  # -> flatten(Result)
random_3 = Random(Range=bnd_6, Number=Slider(3, range=0..10), Seed=Slider(2, range=0..10))
item_2 = ListItem(List=midpt_4, Index=random_2, Wrap=True)
item_3 = ListItem(List=midpt_6, Index=random_3, Wrap=True)

mst = MST(BasePoints=merge)  # -> PointPointTopology, ConnectionPointTopology, Lines
polyoffset = PolylineOffset(
    Polylines=mst.Lines,
    Distance=Slider(1.59, range=1..3),
    Plane=pt_2,
    Tolerance=0.01,
    ClosedFillet=Slider(0, range=0..2),
    OpenFillet=Slider(0, range=0..2),
    Miter=2)  # -> Contour, Holes
project = Project(Geometry=[polyoffset.Contour, circle_2], Plane=pt_2)  # -> flatten(Geometry), Transform
runion = RegionUnion(Curves=project.Geometry, Plane=pt_2)
reb = RebuildCurve(Curve=runion, Degree=Slider(3, range=0..10), Count=10, Tangents=False)

merge_2 = Merge(Data1=pt, Data2=item_2)  # -> flatten(Result)
merge_3 = Merge(Data1=pt_3, Data2=item_3)  # -> flatten(Result)

mst_2 = MST(BasePoints=merge_3)  # -> PointPointTopology, ConnectionPointTopology, Lines
polyoffset_2 = PolylineOffset(
    Polylines=mst_2.Lines,
    Distance=Slider(1.59, range=1..3),
    Plane=pt_3,
    Tolerance=0.01,
    ClosedFillet=Slider(0, range=0..2),
    OpenFillet=Slider(0, range=0..2),
    Miter=2)  # -> Contour, Holes
project_2 = Project(Geometry=[polyoffset_2.Contour, circle_3], Plane=pt_3)  # -> flatten(Geometry), Transform
runion_2 = RegionUnion(Curves=project_2.Geometry, Plane=pt_3)

mst_3 = MST(BasePoints=merge_2)  # -> PointPointTopology, ConnectionPointTopology, Lines
polyoffset_3 = PolylineOffset(
    Polylines=mst_3.Lines,
    Distance=Slider(1.59, range=1..3),
    Plane=pt,
    Tolerance=0.01,
    ClosedFillet=Slider(0, range=0..2),
    OpenFillet=Slider(0, range=0..2),
    Miter=2)  # -> Contour, Holes
project_3 = Project(Geometry=[polyoffset_3.Contour, circle], Plane=pt)  # -> flatten(Geometry), Transform
runion_3 = RegionUnion(Curves=project_3.Geometry, Plane=pt)

reb_2 = RebuildCurve(Curve=runion_3, Degree=Slider(3, range=0..10), Count=10, Tangents=False)
reb_3 = RebuildCurve(Curve=runion_2, Degree=Slider(3, range=0..10), Count=10, Tangents=False)
item_4 = ListItem(List=midpt_4, Index=0, Wrap=True)
item_5 = ListItem(List=midpt_6, Index=0, Wrap=True)
dom = ConstructDomain(DomainStart=Slider(1, range=1..5), DomainEnd=Slider(3.28, range=1..5))
number_slider_9 = Slider(0.2, range=0..1)

# ----
# walkway width
number_slider_10 = Slider(1.07, range=0..10)

radius_openings = Number()

# ----
# units contour
# FIRE CYARD
geo_4 = Geometry([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])
debrep_10 = DeconstructBrep(Brep=geo_4)  # -> Faces, Edges, Vertices
area_7 = Area(Geometry=debrep_10.Faces)  # -> Area, Centroid
pdecon_4 = Deconstruct(Point=area_7.Centroid)  # -> XComponent, YComponent, ZComponent
panel_7 = Panel(pdecon_4.ZComponent)
panel_8 = Panel(pdecon_4.ZComponent)
ma_4 = MassAddition(Input=panel_7)  # -> Result, PartialResults
lng_4 = ListLength(List=panel_7)
division_4 = Division(A=ma_4.Result, B=lng_4)

# ----
# always sleect the top f
# aces and make sno sense
smaller_7 = SmallerThan(FirstNumber=pdecon_4.ZComponent, SecondNumber=division_4)  # -> SmallerThan, OrEqualTo
larger_4 = LargerThan(FirstNumber=pdecon_4.ZComponent, SecondNumber=division_4)  # -> LargerThan, OrEqualTo
dispatch_7 = Dispatch(List=debrep_10.Faces, DispatchPattern=larger_4.OrEqualTo)  # -> ListA, ListB
srf_7 = Surface(dispatch_7.ListB)

# ----
# remove this when solved
bnd_7 = Bounds(Numbers=flatten(pdecon_4.ZComponent))
dedomain_4 = DeconstructDomain(Domain=bnd_7)  # -> Start, End
subtraction_4 = Subtraction(A=dedomain_4.End, B=dedomain_4.Start)
Z_7 = UnitZ(Factor=subtraction_4)
srf_8 = Surface(dispatch_7.ListA)
neg_7 = Negative(Value=Z_7)
move_4 = Move(Geometry=srf_8, Motion=neg_7)  # -> Geometry, Transform

debrep_11 = DeconstructBrep(Brep=move_4.Geometry)  # -> Faces, Edges, Vertices
area_8 = Area(Geometry=debrep_11.Faces)  # -> Area, flatten(Centroid)
midpt_7 = CurveMiddle(Curve=debrep_11.Edges)
avr_4 = Average(Input=area_8.Centroid)
ln_4 = Line(StartPoint=avr_4, EndPoint=midpt_7)
len_4 = Length(Curve=ln_4)
smaller_8 = SmallerThan(FirstNumber=len_4, SecondNumber=Slider(12.13, range=10..16))  # -> SmallerThan, OrEqualTo
dispatch_8 = Dispatch(List=debrep_11.Edges, DispatchPattern=smaller_8.SmallerThan)  # -> ListA, ListB
crv_7 = Curve(dispatch_8.ListB)

# ----
# curve
crv_8 = Curve(dispatch_8.ListA)

join_4 = JoinCurves(Curves=flatten(crv_8), Preserve=False)
debrep_12 = DeconstructBrep(Brep=join_4)  # -> Faces, Edges, Vertices
shift_4 = ShiftList(List=debrep_12.Edges, Shift=number_slider, Wrap=True)

# ----
# center point
pcen_4 = PolygonCenter(Polyline=join_4)  # -> CenterV, CenterE, CenterA

# ----
# CENTER RADIUS
number_slider_11 = Slider(4, range=0..10)
pt_4 = Point(pcen_4.CenterV)
circle_4 = CircleCNR(Center=pt_4, Normal=Vector(0, 0, 1), Radius=number_slider_11)

# ----
# sorted points
midpt_8 = CurveMiddle(Curve=shift_4)

# ----
# FLOOR
Z_8 = UnitZ(Factor=number_slider_5)
boundary_4 = BoundarySurfaces(Edges=join_4)
neg_8 = Negative(Value=Z_8)
extr_4 = Extrude(Base=boundary_4, Direction=neg_8)

bnd_8 = Bounds(Numbers=midpt_8)

points_4 = PointList(Points=midpt_8, Size=Slider(1, range=0..1))

random_4 = Random(Range=bnd_8, Number=Slider(2, range=0..10), Seed=Slider(6, range=0..10))
item_6 = ListItem(List=midpt_8, Index=random_4, Wrap=True)

merge_4 = Merge(Data1=pt_4, Data2=item_6)  # -> flatten(Result)
mst_4 = MST(BasePoints=merge_4)  # -> PointPointTopology, ConnectionPointTopology, Lines
polyoffset_4 = PolylineOffset(
    Polylines=mst_4.Lines,
    Distance=Slider(1.59, range=1..3),
    Plane=pt_4,
    Tolerance=0.01,
    ClosedFillet=Slider(0, range=0..2),
    OpenFillet=Slider(0, range=0..2),
    Miter=2)  # -> Contour, Holes
project_4 = Project(Geometry=[polyoffset_4.Contour, circle_4], Plane=pt_4)  # -> flatten(Geometry), Transform
runion_4 = RegionUnion(Curves=project_4.Geometry, Plane=pt_4)
reb_4 = RebuildCurve(Curve=runion_4, Degree=Slider(3, range=0..10), Count=10, Tangents=False)

merge_5 = Merge(Data1=pt_3, Data2=pt, Data3=pt_4, Data4=pt_2)  # -> flatten(Result)

number_slider_12 = Slider(113, range=0..1000)
pl_3pt = Plane3Pt(PointA=pt_3, PointB=pt, PointC=pt_4)
planesrf = PlaneSurface(Plane=pl_3pt, XSize=number_slider_12, YSize=number_slider_12)
item_7 = ListItem(List=merge_5, Index=0, Wrap=True)  # -> Item, Item1, Item2
area_9 = Area(Geometry=planesrf)  # -> Area, Centroid
pt_5 = Point(item_7.Item2)
orient = Orient(Geometry=planesrf, Source=area_9.Centroid, Target=pt_5)  # -> Geometry, Transform
Z_9 = UnitZ(Factor=1)
extr_5 = Extrude(Base=orient.Geometry, Direction=Z_9)

item_8 = ListItem(List=midpt_8, Index=0, Wrap=True)
# RAMP POINTS
merge_6 = Merge(Data1=pt_3, Data2=item_5, Data3=pt, Data4=item_4, Data5=pt_4, Data6=item_8, Data7=pt_2)  # -> flatten(Result)
merge_7 = Merge(Data1=merge_6, Data2=merge_3, Data3=item_2, Data4=item_6, Data5=item)  # -> flatten(Result)
rdpoints = RemoveDuplicatePointsKaramba3D(Point=merge_7, LimitDistance=0.005)  # -> OutPoint, Info, Indexes
mst_5 = MST(BasePoints=merge_6)  # -> PointPointTopology, ConnectionPointTopology, Lines
lng_5 = ListLength(List=rdpoints.OutPoint)
range = Range(Domain=dom, Steps=lng_5)
mst_6 = MST(BasePoints=flatten(rdpoints.OutPoint))  # -> PointPointTopology, ConnectionPointTopology, Lines
clean = CleanTree(RemoveNulls=True, RemoveInvalid=True, RemoveEmpty=False, Tree=mst_5.Lines)
cir = Circle(Plane=merge_7, Radius=range)
polyoffset_5 = PolylineOffset(
    Polylines=mst_6.Lines,
    Distance=Slider(1.59, range=1..3),
    Plane=pl_3pt,
    Tolerance=0.01,
    ClosedFillet=Slider(0, range=0..2),
    OpenFillet=Slider(0, range=0..2),
    Miter=2)  # -> Contour, Holes
boundary_5 = BoundarySurfaces(Edges=polyoffset_5.Contour)
crv_9 = Curve(clean)
runion_5 = RegionUnion(Curves=[cir, polyoffset_5.Contour], Plane=pl_3pt)
crv_10 = Curve(runion_5)

join_5 = JoinCurves(Curves=crv_9, Preserve=False)
number_slider_13 = Slider(1.5, range=0..10)
pframe = PerpFrame(Curve=reparameterize(join_5), Parameter=Slider(0, range=0..1))
end = EndPoints(Curve=join_5)  # -> Start, End
rectangle = Rectangle(Plane=pframe, XSize=Domain(-1, 1), YSize=Slider(10, range=0..10), Radius=0)  # -> Rectangle, Length
area_10 = Area(Geometry=rectangle.Rectangle)  # -> Area, Centroid
orient_2 = Orient(Geometry=rectangle.Rectangle, Source=area_10.Centroid, Target=end.Start)  # -> Geometry, Transform

number_slider_14 = Slider(1, range=0..10)
join_6 = JoinCurves(Curves=crv_9, Preserve=False)
number_slider_15 = Slider(1.5, range=0..10)
pframe_2 = PerpFrame(Curve=reparameterize(join_6), Parameter=Slider(0, range=0..1))
end_2 = EndPoints(Curve=join_6)  # -> Start, End
rectangle_2 = Rectangle(Plane=pframe_2, XSize=Domain(-1, 1), YSize=Slider(0.2, range=0..1), Radius=0)  # -> Rectangle, Length
area_11 = Area(Geometry=rectangle_2.Rectangle)  # -> Area, Centroid
orient_3 = Orient(Geometry=rectangle_2.Rectangle, Source=area_11.Centroid, Target=end_2.Start)  # -> Geometry, Transform

join_7 = JoinCurves(Curves=crv_9, Preserve=False)
pframe_3 = PerpFrame(Curve=reparameterize(join_7), Parameter=Slider(0, range=0..1))
end_3 = EndPoints(Curve=join_7)  # -> Start, End
rectangle_3 = Rectangle(Plane=pframe_3, XSize=Slider(22, range=0..100), YSize=Slider(0.2, range=0..1), Radius=0)  # -> Rectangle, Length
area_12 = Area(Geometry=rectangle_3.Rectangle)  # -> Area, Centroid
orient_4 = Orient(Geometry=rectangle_3.Rectangle, Source=area_12.Centroid, Target=end_3.Start)  # -> Geometry, Transform

# ----
# fix perpendicularity
swp1 = Sweep1(Rail=join_5, Sections=orient_2.Geometry, Miter=1)
swp1_2 = Sweep1(Rail=join_6, Sections=orient_3.Geometry, Miter=1)

merge_8 = Merge(Data1=extr_3, Data2=extr_2, Data3=extr_4, Data4=extr)
merge_9 = Merge(Data1=boundary_3, Data2=boundary_2, Data3=boundary_4, Data4=boundary)
cap = CapHoles(Brep=merge_8)
cap_2 = CapHoles(Brep=swp1)

# ----
# option 2 MILTIPIPE
# MULTIPIPE FOR OPENINGS
end_4 = EndPoints(Curve=crv_9)  # -> Start, End
merge_10 = Merge(Data1=end_4.Start, Data2=end_4.End)
pdecon_5 = Deconstruct(Point=merge_10)  # -> XComponent, YComponent, ZComponent
dom_2 = ConstructDomain(DomainStart=Slider(1, range=0..25), DomainEnd=Slider(1.5, range=0..25))
bnd_9 = Bounds(Numbers=pdecon_5.XComponent)
remap = RemapNumbers(Value=pdecon_5.XComponent, Source=bnd_9, Target=Domain(0, 1))  # -> Mapped, Clipped
graph = GraphMapper(
    remap.Mapped,
    x0=0,
    x1=1,
    y0=0,
    y1=1,
    container_name="Bezier",
    cpx=[0, 0.9037944674, 0.2178725153, 1],
    cpy=[0, 0.2222495079, 0.938179791, 1])
remap_2 = RemapNumbers(Value=graph, Source=Domain(0, 1), Target=dom_2)  # -> Mapped, Clipped
randomize = RandomizeNumbers(Number=remap_2.Mapped, Ratio=Slider(0.55, range=0..1))
mp = MultiPipe(
    Curves=crv_9,
    NodeSize=Slider(4, range=0..10),
    SizePoints=merge_10,
    EndOffset=1,
    StrutSize=1,
    Segment=0,
    KinkAngle=0.6,
    CubeFit=0)
mp_2 = MultiPipe(
    Curves=crv_9,
    NodeSize=number_slider_10,
    SizePoints=merge_10,
    EndOffset=Slider(0.28, range=0..10),
    StrutSize=1,
    Segment=0,
    KinkAngle=0.6,
    CubeFit=0)
toggle = GroupToggle(ToggleActive=True, ToggleVisible=False)  # disabled

sdiff = SolidDifference(BrepsA=cap, BrepsB=cap_2)
swp1_3 = Sweep1(Rail=join_7, Sections=orient_4.Geometry, Miter=1)
brep = Brep(sdiff)
debrep_13 = DeconstructBrep(Brep=swp1_3)  # -> Faces, Edges, Vertices
area_13 = Area(Geometry=debrep_13.Faces)  # -> Area, Centroid
larger_5 = LargerThan(FirstNumber=area_13.Area, SecondNumber=Slider(153, range=0..1000))  # -> LargerThan, OrEqualTo
dispatch_9 = Dispatch(List=debrep_13.Faces, DispatchPattern=larger_5.OrEqualTo)  # -> ListA, ListB
item_9 = ListItem(List=dispatch_9.ListA, Index=0, Wrap=True)  # -> Item, Item1, Item2, Item3, Item4, Item5, Item6, Item7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
srf_9 = Surface([item_9.Item1, item_9.Item3, item_9.Item5, item_9.Item7, item_9.Item9, item_9.Item11])

# ----
# MESHING
subd_control_polygon = SubDControlPolygon(SubD=mp_2)
mesh_explode = MeshExplode(Mesh=subd_control_polygon, Interpolate=False)
mesh_area = MeshArea(Mesh=mesh_explode)  # -> Area, Centroid
deconstruct = Deconstruct(Point=mesh_area.Centroid)  # -> XComponent, YComponent, ZComponent
larger_than = LargerThan(FirstNumber=deconstruct.ZComponent, SecondNumber=Slider(20, range=0..100))  # -> LargerThan, OrEqualTo
cull_pattern = CullPattern(List=mesh_explode, CullPattern=larger_than.LargerThan)
pln = Plane(pl_3pt)
project_5 = Project(Geometry=cull_pattern, Plane=pln)  # -> Geometry, Transform
mesh_join = MeshJoin(Meshes=project_5.Geometry)

weld = WeldMesh(Mesh=mesh_join, Angle=3.141592654)
face_boundaries = FaceBoundaries(Mesh=weld)
runion_6 = RegionUnion(Curves=face_boundaries)
extr_6 = Extrude(Base=runion_6)
project_6 = Project(Curve=runion_6, Brep=merge_9, Direction=Vector(0, 0, 1))
