# Grasshopper definition Walls & Roofs .gh (Grasshopper 1.0.7)
# plug-ins: Kangaroo2 Components, MeshEdit Components, MetaHopper, Pufferfish, Human, Weaverbird, Speckle 2, ShapeDiverForGrasshopper

# ----
# Units (Midterm Location)
toggle = GroupToggle(ToggleActive=True, ToggleVisible=False)  # disabled
geo = Geometry(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)  # disabled
swatch = ColourSwatch(SwatchColor=RGB(161, 161, 161))  # disabled
preview = CustomPreview(Geometry=geo, Material=swatch)  # disabled

number_slider = Slider(137, range=0..144)  # disabled
panel = Panel("0")  # disabled
dom = ConstructDomain(DomainStart=panel, DomainEnd=number_slider)  # disabled
range = Range(Domain=dom, Steps=number_slider)  # disabled
item = ListItem(List=[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], Index=range, Wrap=True)  # disabled
lng = ListLength(List=item)  # disabled
angsplitmsh = AngleSplitMesh(Mesh=item, Angle=0, Opposite=False)  # -> Split, R; disabled
series = Series(Start=0, Step=1, Count=lng)  # disabled
medges = MeshEdges(Mesh=angsplitmsh.Split)  # -> NakedEdges, InteriorEdges, NonManifoldEdges; disabled
gradient = Gradient(LowerLimit=0, UpperLimit=lng, Parameter=series, stops=[0: RGB(255, 255, 255), 1: RGB(135, 0, 0)])  # disabled
number_slider_2 = Slider(1, range=0..100)  # disabled
geo_2 = Geometry(medges.NakedEdges)  # disabled
swatch_2 = ColourSwatch(SwatchColor=RGB(0, 0, 0))  # disabled
preview_2 = CustomPreview(Geometry=item, Material=gradient)  # disabled
# UNITS & FLOORS (Sorted by Levels)
previewlw = CustomPreviewLineweights(Geometry=geo_2, Shader=swatch_2, Thickness=number_slider_2, Absolute=False)  # disabled

# ---- group: Obsticles
mesh = Mesh(item)  # disabled

brep = Brep([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])  # disabled

# ----
brep_2 = Brep([<brep referenced from the Rhino model> x72])

# ---- group: UNITS (LATEST LOCATION)
brep_3 = Brep([<brep referenced from the Rhino model> x71])

# ----
# 03
# 02
# 01
# 00
volume = Volume(Geometry=brep_2)  # -> Volume, Centroid
pdecon = Deconstruct(Point=volume.Centroid)  # -> XComponent, YComponent, ZComponent
cset = CreateSet(List=pdecon.ZComponent)  # -> Set, Map
pt = Point([<point referenced from the Rhino model> x4])

# ---- group: New Site Mesh
mesh_2 = Mesh(<mesh referenced from the Rhino model>)

# ----
sort = SortList(Keys=cset.Set)  # -> Keys, ValuesA
mindex = MemberIndex(Set=pdecon.ZComponent, Member=graft(sort.Keys))  # -> Index, Count

# ---- group: Projection Plane Point
pt_2 = Point(<point referenced from the Rhino model>)

# ---- group: Cell Outline
crv = Curve(<curve referenced from the Rhino model>)

crv_2 = Curve(<curve referenced from the Rhino model>)

# ---- group: Units Grouped by Level
item_2 = ListItem(List=brep_2, Index=mindex.Index, Wrap=True)

# ----
# Wall Attempts
toggle_2 = GroupToggle(ToggleActive=True, ToggleVisible=False)  # disabled
crv_3 = Curve(<curve referenced from the Rhino model>)  # disabled
flip = FlipCurve(Curve=crv_3)  # -> Curve, Flag; disabled
crv_4 = Curve(<curve referenced from the Rhino model>)  # disabled
number_slider_3 = Slider(8, range=0..30)  # disabled
number_slider_4 = Slider(-1, range=-1..0)  # disabled
disc = Discontinuity(Curve=flip.Curve, Level=1)  # -> Points, Parameters; disabled
disc_2 = Discontinuity(Curve=crv_4, Level=1)  # -> Points, Parameters; disabled
number_slider_5 = Slider(0.08, range=0..3)  # disabled
shift = ShiftList(List=disc.Points, Shift=number_slider_3, Wrap=True)  # disabled
shift_2 = ShiftList(List=disc_2.Points, Shift=number_slider_4, Wrap=True)  # disabled
nurbs = NurbsCurve(Vertices=shift_2, Degree=3, Periodic=True)  # -> Curve, Length, Domain; disabled
Z = UnitZ(Factor=number_slider_5)  # disabled
nurbs_2 = NurbsCurve(Vertices=shift, Degree=3, Periodic=True)  # -> Curve, Length, Domain; disabled
move = Move(Geometry=nurbs.Curve, Motion=Z)  # -> Geometry, Transform; disabled
merge = Merge(Data1=nurbs.Curve, Data3=nurbs_2.Curve)  # disabled
loft = Loft(Curves=merge, Options={Adjust=False, Closed=False, LoftEnds=0, LoftSimp=0, LoftType=0, Rebuild=10, Refit=0.01})  # disabled
swatch_3 = ColourSwatch(SwatchColor=RGB(133, 0, 0))  # disabled
preview_3 = CustomPreview(Geometry=loft, Material=swatch_3)  # disabled

# ----
# Contour Lines (Projected on plane above)
xy = XYPlane(Origin=pt_2)
project = Project(Geometry=flatten(item_2), Plane=xy)  # -> Geometry, Transform
debrep = DeconstructBrep(Brep=project.Geometry)  # -> Faces, flatten(Edges), Vertices
len = Length(Curve=debrep.Edges)
larger = LargerThan(FirstNumber=len, SecondNumber="0.001")  # -> LargerThan, OrEqualTo
cull = CullPattern(List=debrep.Edges, CullPattern=larger.LargerThan)
panel_2 = Panel("""0
1""")
cull_2 = CullPattern(List=cull, CullPattern=panel_2)
join = JoinCurves(Curves=cull_2, Preserve=False)
runion = RegionUnion(Curves=flatten(join))
item_3 = ListItem(List=runion, Index=0, Wrap=True)  # -> Item, Item1
number_slider_6 = Slider(0.49, range=0..20)
disc_3 = Discontinuity(Curve=item_3.Item, Level=1)  # -> Points, Parameters
nurbs_3 = NurbsCurve(Vertices=disc_3.Points, Degree=3, Periodic=True)  # -> Curve, Length, Domain
neg = Negative(Value=number_slider_6)
xy_2 = XYPlane(Origin=Point(0, 0, 0))
offset = OffsetCurve(Curve=nurbs_3.Curve, Distance=number_slider_6, Corners=3)
offset_2 = OffsetCurve(Curve=offset, Distance=neg, Plane=xy_2, Corners=1)
offset_3 = OffsetCurve(Curve=offset_2, Distance=neg, Plane=xy_2, Corners=1)
series_2 = Series(Start=Slider(0.06, range=-2..5), Step=Slider(2.03, range=-2..5), Count=Slider(7, range=0..10))
offset_4 = OffsetCurve(Curve=nurbs_3.Curve, Distance=series_2, Corners=1)  # -> flatten(Curve)

bang = ExplodeTree(Data=item_2)  # -> Branch0, Branch1, Branch2, Branch3
debrep_2 = DeconstructBrep(Brep=item_2)  # -> Faces, Edges, Vertices
area = Area(Geometry=debrep_2.Faces)  # -> Area, Centroid
brep_4 = Brep(bang.Branch3)
pdecon_2 = Deconstruct(Point=area.Centroid)  # -> XComponent, YComponent, ZComponent
brep_5 = Brep(item_2)
sort_2 = SortList(Keys=pdecon_2.ZComponent, ValuesA=debrep_2.Faces)  # -> Keys, ValuesA
panel_3 = Panel()
panel_4 = Panel()
volume_2 = Volume(Geometry=item_2)  # -> Volume, Centroid
panel_5 = Panel("https://macad.speckle.xyz/streams/4975f9f0a8/commits/8fbb543497")
brep_6 = Brep([<brep referenced from the Rhino model> x71])
item_4 = ListItem(List=sort_2.ValuesA, Index=0, Wrap=True)  # -> Item1, Item
avr = Average(Input=volume_2.Centroid)
esokv = ExtendSpeckleObjectByKeyValue(Keys=panel_3, Values=panel_4, selectedKitName="Objects")

# ---- group: Floors Grouped by Levels
trim = TrimTree(Tree=item_4.Item, Depth=1)

# ----
receive = Receive(
    Stream=panel_5,
    AutoReceive=False,
    CurrentComponentState="expired",
    ExpandOutput=True,
    ReceiveOnOpen=False,
    ReceivedCommitId="8fbb543497",
    StreamWrapper="https://macad.speckle.xyz/streams/4975f9f0a8/commits/8fbb543497",
    selectedKitName="Objects")  # -> Info, CONTOURS, SOIL; disabled
panel_6 = Panel("https://macad.speckle.xyz/streams/4975f9f0a8/branches/site%2F04-community-site")

# ---- group: Community Site Stream (Last Commit at the time)
panel_7 = Panel("https://macad.speckle.xyz/streams/4975f9f0a8/commits/8fbb543497")

# ----
join_2 = BrepJoin(Breps=trim)  # -> Breps, Closed
bbox = BoundingBox(Content=brep_6, Plane=PlaneXY(0, 0, 0), UnionBox=True)  # -> Box, Box_2
edges = BrepEdges(Brep=join_2.Breps)  # -> Naked, Interior, NonManifold
volume_3 = Volume(Geometry=bbox.Box_2)  # -> Volume, Centroid
geo_3 = Geometry(edges.Naked)

crv_5 = Curve(item_3.Item1)
disc_4 = Discontinuity(Curve=crv_5, Level=1)  # -> Points, Parameters
nurbs_4 = NurbsCurve(Vertices=disc_4.Points, Degree=3, Periodic=True)  # -> Curve, Length, Domain

receive_2 = Receive(
    Stream=panel_7,
    AutoReceive=False,
    CurrentComponentState="expired",
    ExpandOutput=True,
    ReceiveOnOpen=False,
    ReceivedCommitId="8fbb543497",
    StreamWrapper="https://macad.speckle.xyz/streams/4975f9f0a8/commits/8fbb543497",
    selectedKitName="Objects")  # -> Info, CONTOURS, SOIL; disabled
send = Send(
    Stream=panel_6,
    Message="First one here :)",
    Brep=brep_6,
    AutoSend=False,
    BaseId="4211a9499277c30a864f8af716dcf53c",
    CurrentComponentState="expired",
    KitName="Objects",
    OutputWrappers="https://macad.speckle.xyz\t4975f9f0a8\t25e44ca5db",
    UseDefaultCache=True,
    selectedKitName="Objects")  # disabled
sph = Sphere(Base=volume_3.Centroid, Radius=Slider(100, range=0..1000))
panel_8 = Panel("""BIMSC-PROJECT
BIMSC-ORIGINATOR
BIMSC-VOLUME
BIMSC-LEVEL
BIMSC-TYPE
BIMSC-MATERIAL""")
panel_9 = Panel("""ELEMENTAL MARS
G06
VOLUME
MULTIPLE
SITE-PLACE HOLDER
NO MATERIAL""")
disc_5 = Discontinuity(Curve=geo_3, Level=1)  # -> flatten(Points), Parameters
pt_3 = Point([<point referenced from the Rhino model> x4])
boundary = BoundarySurfaces(Edges=geo_3)
rev = ReverseList(List=pt_3)

# ---- group: Materials Stream
panel_10 = Panel("https://macad.speckle.xyz/streams/4975f9f0a8/commits/d13e3ec6c6")

# ----
dso = DeconstructSpeckleObject(SpeckleObject=receive_2.SOIL, selectedKitName="Objects")
area_2 = Area(Geometry=boundary)  # -> Area, Centroid

# ---- group: G06 Stream
panel_11 = Panel("https://macad.speckle.xyz/streams/4975f9f0a8/branches/students%2Fg06-site_locations")

# ----
preview_4 = CustomPreview(Geometry=boundary, Material=ColourSwatch(SwatchColor=RGB(117, 117, 117)))
trim_2 = TrimTree(Tree=area_2.Centroid, Depth=1)
cps = ClosestPoints(Point=pt_3, Cloud=disc_4.Points, Count="24")  # -> ClosestPoint, CPIndex, Distance
cir = Circle(Plane=pt_3, Radius=1)  # -> graft(Circle)
mesh_3 = Mesh(dso)
receive_3 = Receive(
    Stream=panel_10,
    AutoReceive=False,
    CurrentComponentState="expired",
    ExpandOutput=True,
    ReceiveOnOpen=False,
    ReceivedCommitId="d13e3ec6c6",
    StreamWrapper="https://macad.speckle.xyz/streams/4975f9f0a8/commits/d13e3ec6c6",
    selectedKitName="Objects")  # -> Info, Materials; disabled
pdecon_3 = Deconstruct(Point=trim_2)  # -> XComponent, YComponent, ZComponent
esokv_2 = ExtendSpeckleObjectByKeyValue(SpeckleObject=brep_5, Keys=panel_8, Values=panel_9, selectedKitName="Objects")
sovk = SpeckleObjectValueByKey(Object=receive_2.SOIL, Key="A4", selectedKitName="Objects")
alongcrv = SortAlongCurve(Points=cps.ClosestPoint, Curve=cir)  # -> Points, Indices
bang_2 = ExplodeTree(Data=alongcrv.Points)  # -> _00000, _00010, _00020, _00030
item_5 = ListItem(List=pdecon_3.ZComponent, Index=0, Wrap=True)
dso_2 = DeconstructSpeckleObject(SpeckleObject=receive_3.Materials, selectedKitName="Objects")
item_6 = ListItem(List=flatten(mesh_3), Index=Slider(3, range=0..20), Wrap=True)
panel_12 = Panel(item_5)
send_2 = Send(
    Stream=panel_11,
    Message="Footprint",
    Data=esokv_2,
    AutoSend=False,
    BaseId="5c085f5baf2f57c841840d9e65b2c551",
    CurrentComponentState="expired",
    KitName="Objects",
    OutputWrappers="https://macad.speckle.xyz\t4975f9f0a8\t123ad7dd3c",
    UseDefaultCache=True,
    selectedKitName="Objects")  # disabled
merge_2 = Merge(Data1=Slider(1, range=0..23), Data2=Slider(1, range=0..23), Data3=Slider(1, range=0..23), Data4=Slider(7, range=0..23))  # -> graft(Result)
pt_4 = Point(bang_2._00030)
# Speckle
panel_13 = Panel(dso_2)
shift_3 = ShiftList(List=alongcrv.Points, Shift=merge_2, Wrap=True)
pline = PolyLine(Vertices=shift_3, Closed=True)
boundary_2 = BoundarySurfaces(Edges=pline)
area_3 = Area(Geometry=boundary_2)  # -> Area, Centroid
pdecon_4 = Deconstruct(Point=area_3.Centroid)  # -> XComponent, YComponent, ZComponent
points = PointList(Points=shift_3, Size=Slider(1, range=0..10))
subtraction = Subtraction(A=item_5, B=pdecon_4.ZComponent)
panel_14 = Panel(pdecon_4.ZComponent)
Z_2 = UnitZ(Factor=subtraction)
panel_15 = Panel(subtraction)
move_2 = Move(Geometry=boundary_2, Motion=Z_2)  # -> Geometry, Transform
# Pavilions Outline - Curved
number_slider_7 = Slider(-0.4, range=-2..2)
brep_7 = Brep(item_2)
volume_4 = Volume(Geometry=brep_7)  # -> Volume, Centroid
plfit = PlaneFit(Points=flatten(volume_4.Centroid))  # -> Plane, Deviation
Z_3 = UnitZ(Factor=Slider(1.5, range=-5..5))
offset_5 = OffsetCurve(Curve=nurbs_4.Curve, Distance=number_slider_7, Corners=1)
Z_4 = UnitZ(Factor=Slider(-1.2, range=-5..0))
move_3 = Move(Geometry=plfit.Plane, Motion=Z_3)  # -> Geometry, Transform
move_4 = Move(Geometry=plfit.Plane, Motion=Z_4)  # -> Geometry, Transform
Z_5 = UnitZ(Factor=1)
projecta = ProjectAlong(Geometry=offset_5, Plane=move_3.Geometry, Direction=Z_5)  # -> Geometry, Transform

# ----
# Terrain & Contours
Z_6 = UnitZ(Factor=1)
projecta_2 = ProjectAlong(Geometry=offset_4, Plane=move_4.Geometry, Direction=Z_6)  # -> Geometry, Transform

# ---- group: Solid Difference
number_slider_8 = Slider(5, range=0..10)  # disabled
number_slider_9 = Slider(-0.37, range=-2..0)  # disabled
toggle_3 = GroupToggle(ToggleActive=True, ToggleVisible=False)  # disabled
series_3 = Series(Start=0, Step=number_slider_9, Count=number_slider_8)  # disabled
Z_7 = UnitZ(Factor=series_3)  # disabled
number_slider_10 = Slider(1.5, range=0..20)  # disabled
move_5 = Move(Geometry=reverse(projecta_2.Geometry), Motion=Z_7)  # -> Geometry, Transform; disabled
number_slider_11 = Slider(0, range=-1..1)  # disabled
Z_8 = UnitZ(Factor=number_slider_10)  # disabled
addition = Addition(A=number_slider_9, B=number_slider_11)  # disabled
move_6 = Move(Geometry=move_5.Geometry, Motion=Z_8)  # -> Geometry, Transform; disabled
Z_9 = UnitZ(Factor=addition)  # disabled
extr = Extrude(Base=move_6.Geometry, Direction=Z_9)  # disabled
cap = CapHoles(Brep=extr)  # disabled
sunion = SolidUnion(Breps=cap)  # disabled

# ----
panel_16 = Panel("""0
0
1""")

# ---- group: Original Wall Control Points
# Pavilions Outline - Dispatched Points
pt_5 = Point(disc_4.Points)

# ----
boundary_3 = BoundarySurfaces(Edges=offset_3)  # disabled
number_slider_12 = Slider(1, range=0..10)  # disabled
toggle_4 = GroupToggle(ToggleActive=True, ToggleVisible=False)  # disabled
mesh_4 = MeshBrep(
    Brep=boundary_3,
    Settings={GridMaxCount=0, GridMinCount=16, JaggedSeams=False, MaxEdgeLength=0, MinEdgeLength=0.0001, MinTolerance=0, Refine=True, RefineAngle=0, RelativeTolerance=0.65, SimplePlanes=True, Tolerance=0})  # disabled
triremesh = TriRemesh(Geometry=mesh_4, Length=number_slider_12, Iterations=25)  # -> Triangulation, Dual, Creases; disabled
nv = NakedVertices(Mesh=triremesh.Triangulation)  # -> ClothedIndex, NakedIndex, ClothedPts, NakedPts; disabled
medges_2 = MeshEdges(Mesh=triremesh.Triangulation)  # -> NakedEdges, InteriorEdges, NonManifoldEdges; disabled
demesh = DeconstructMesh(Mesh=triremesh.Triangulation)  # -> Vertices, Faces, Colours, Normals; disabled
len_2 = Length(Curve=medges_2.InteriorEdges)  # disabled
number_slider_13 = Slider(0, range=-10..10)  # disabled
number_slider_14 = Slider(2.71, range=0..10)  # disabled
number_slider_15 = Slider(0.25, range=0..1)  # disabled
number_slider_16 = Slider(63, range=0..100)  # disabled
vec = VectorXYZ(XComponent=number_slider_13, YComponent=0, ZComponent=number_slider_14)  # -> Vector, Length; disabled
edgelengths = EdgeLengths(Mesh=triremesh.Triangulation, LengthFactor=number_slider_15, Strength=number_slider_16)  # disabled
anchor = Anchor(Point=nv.NakedPts, Strength=10000)  # disabled
load = Load(Point=demesh.Vertices, ForceVector=vec.Vector, Weighting=1)  # disabled
show = Show(G=triremesh.Triangulation)  # disabled
entwine = Entwine(Branch00=show, Branch01=edgelengths, Branch02=load, Branch03=anchor, FlattenInputs=True)  # disabled
toggle_5 = BooleanToggle(False)  # disabled
button = Button()  # disabled
bouncysolver = BouncySolver(GoalObjects=entwine, Reset=button, Threshold=1e-15, Tolerance=0.0001, Damping=0.99, Iterations=10, On=toggle_5)  # -> I, V, O; disabled
item_7 = ListItem(List=bouncysolver.O, Index=0, Wrap=True)  # disabled
medges_3 = MeshEdges(Mesh=item_7)  # -> NakedEdges, InteriorEdges, NonManifoldEdges; disabled

# ----
# Units (Pebbles)
brep_8 = Brep(item_2)
mesh_5 = MeshBrep(
    Brep=brep_8,
    Settings={GridMaxCount=0, GridMinCount=16, JaggedSeams=False, MaxEdgeLength=0, MinEdgeLength=0.0001, MinTolerance=0, Refine=True, RefineAngle=0, RelativeTolerance=0.65, SimplePlanes=True, Tolerance=0})
wbcatmullclark = WeaverbirdsCatmullClarkSubdivision(MeshCurves=mesh_5, Level=Slider(2, range=0..2), SmoothNakedEdges=Slider(0, range=0..2))
preview_5 = CustomPreview(Geometry=brep_8, Material=ColourSwatch(SwatchColor=RGBA(189, 189, 189, 205)))  # disabled
preview_6 = CustomPreview(Geometry=wbcatmullclark, Material=ColourSwatch(SwatchColor=RGB(145, 142, 132)))

cull_3 = CullPattern(List=pt_5, CullPattern=invert(panel_16))
cull_4 = CullPattern(List=pt_5, CullPattern=panel_16)
project_2 = ProjectPoint(Point=pt_5, Direction=Vector(0, 0, -1), Geometry=boundary)  # -> Point, Index

# ----
# Pavilions Ground
projecta_3 = ProjectAlong(Geometry=crv_5, Plane=move_4.Geometry, Direction=Z_6)  # -> Geometry, Transform
patch = Patch(Points=disc_5.Points, Spans=20, Flexibility=5, Trim=True)
project_3 = Project(Curve=crv_5, Brep=patch, Direction=Vector(0, 0, 1))
srfsplit = SurfaceSplit(Surface=patch, Curves=project_3)
boundary_4 = BoundarySurfaces(Edges=projecta_3.Geometry)
item_8 = ListItem(List=srfsplit, Index="1", Wrap=True)
contour = Contour(Shape=item_8, Point=Point(0, 0, 0), Direction=Vector(0, 0, 1), Distance="0.5")
preview_7 = CustomPreview(Geometry=item_8, Material=ColourSwatch(SwatchColor=RGB(77, 87, 62)))  # disabled

crv_cp = CurveClosestPoint(Point=cull_4, Curve=offset_5)  # -> Point, Parameter, Distance
eval = EvaluateCurve(Curve=offset_5, Parameter=crv_cp.Parameter)  # -> Point, Tangent, Angle
rotate = Rotate(Geometry=eval.Tangent, Angle=1.570796327, Plane=PlaneXY(0, 0, 0))  # -> Geometry, Transform
amp = Amplitude(Vector=rotate.Geometry, Amplitude=Slider(4.2, range=-10..10))
vdis = VectorDisplay(Anchor=eval.Point, Vector=rotate.Geometry)
move_7 = Move(Geometry=cull_4, Motion=amp)  # -> Geometry, Transform

crv_cp_2 = CurveClosestPoint(Point=cull_3, Curve=offset_5)  # -> Point, Parameter, Distance
eval_2 = EvaluateCurve(Curve=offset_5, Parameter=crv_cp_2.Parameter)  # -> Point, Tangent, Angle
rotate_2 = Rotate(Geometry=eval_2.Tangent, Angle=1.570796327, Plane=PlaneXY(0, 0, 0))  # -> Geometry, Transform
amp_2 = Amplitude(Vector=rotate_2.Geometry, Amplitude=Slider(0, range=-10..10))
vdis_2 = VectorDisplay(Anchor=eval_2.Point, Vector=rotate_2.Geometry)
move_8 = Move(Geometry=cull_3, Motion=amp_2)  # -> Geometry, Transform

index = ItemIndex(List=pt_5, Item=cull_4)
index_2 = ItemIndex(List=pt_5, Item=cull_3)
dots = DotDisplay(Point=project_2.Point, Colour=RGB(0, 0, 0), Size=Slider(0.3, range=0..1))
replace = ReplaceItems(List=pt_5, Item=move_7.Geometry, Indices=index, Wrap=False)
replace_2 = ReplaceItems(List=replace, Item=move_8.Geometry, Indices=index_2, Wrap=False)
nurbs_5 = NurbsCurve(Vertices=replace_2, Degree=3, Periodic=True)  # -> Curve, Length, Domain
previewlw_2 = CustomPreviewLineweights(
    Geometry=contour,
    Shader=ColourSwatch(SwatchColor=RGB(255, 255, 255)),
    Thickness=Slider(3.07, range=0..5),
    Absolute=False)

# ---- group: All other segments
number_slider_17 = Slider(0.08, range=0..1)  # disabled
number_slider_18 = Slider(55, range=0..100)  # disabled
multiplication = Multiplication(A=len_2, B=number_slider_17)  # disabled
length_line = LengthLine(Line=medges_2.InteriorEdges, Length=multiplication, Strength=number_slider_18)  # disabled

# ----
srf = Surface(flatten(Tree({0;0;0;0;0;0}: [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], {0;0;0;1;0;0}: [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], {0;0;0;2;0;0}: [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], {0;0;0;3;0;0}: [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])))

project_4 = Project(Curve=offset_5, Brep=patch, Direction=Vector(0, 0, 1))
project_5 = Project(Curve=nurbs_5.Curve, Brep=patch, Direction=Vector(0, 0, 1))
Z_10 = UnitZ(Factor=Slider(3.8, range=-5..5))
Z_11 = UnitZ(Factor=1)  # disabled
Z_12 = UnitZ(Factor=Slider(2.4, range=-10..10))
preview_8 = CustomPreview(Geometry=srf, Material=ColourSwatch(SwatchColor=RGB(242, 255, 0)))  # disabled
move_9 = Move(Geometry=project_5, Motion=Z_10)  # -> Geometry, Transform
projecta_4 = ProjectAlong(Geometry=nurbs_5.Curve, Plane=move_3.Geometry, Direction=Z_11)  # -> Geometry, Transform; disabled
move_10 = Move(Geometry=project_4, Motion=Z_12)  # -> Geometry, Transform
project_6 = Project(Curve=offset_5, Brep=patch, Direction=Vector(0, 0, 1))  # -> flatten(Curve)
number_slider_19 = Slider(369, range=0..1000)
# Sine wave option (Discarded)
panel_17 = Panel("""0.25
0.50
0.75""")

merge_3 = Merge(Data1=flatten(move_9.Geometry), Data2=flatten(move_10.Geometry), Data3=flatten(project_6))
loft_2 = Loft(Curves=merge_3, Options={Adjust=False, Closed=False, LoftEnds=0, LoftSimp=0, LoftType=0, Rebuild=10, Refit=0.01})
offsrf = OffsetSurface(Surface=loft_2, Distance=Slider(-0.3, range=-1..1), BothSides=0, CreateSolid=True)
# Wall
preview_9 = CustomPreview(Geometry=offsrf, Material=ColourSwatch(SwatchColor=RGB(135, 0, 0)))

tweencrv = TweenCurve(CurveA=projecta.Geometry, CurveB=project_6, Factor=panel_17, BlendType=0)
divide = DivideCurve(Curve=tweencrv, Count=number_slider_19, Kinks=False)  # -> Points, Tangents, Parameters
crv_cp_3 = CurveClosestPoint(Point=divide.Points, Curve=tweencrv)  # -> Point, Parameter, Distance
eval_3 = EvaluateCurve(Curve=graft(tweencrv), Parameter=crv_cp_3.Parameter)  # -> Point, Tangent, Angle

series_4 = Series(Start=0, Step=1, Count=number_slider_19)
graph = GraphMapper(series_4, x0=0, x1=1, y0=0, y1=1, container_name="Sine", Equation_px=[0, 0.2289776504], Equation_py=[0, 0.4894908667])
rotate_3 = Rotate(Geometry=eval_3.Tangent, Angle=1.570796327, Plane=PlaneXY(0, 0, 0))  # -> Geometry, Transform
graph_2 = GraphMapper(series_4, x0=0, x1=1, y0=0, y1=1, container_name="Sine", Equation_px=[0, 0.2434082031], Equation_py=[0, 0.5038479567])
vdis_3 = VectorDisplay(Anchor=eval_3.Point, Vector=rotate_3.Geometry)
entwine_2 = Entwine(Branch00=graph_2, Branch01=graph, FlattenInputs=True)
amp_3 = Amplitude(Vector=rotate_3.Geometry, Amplitude=entwine_2)
move_11 = Move(Geometry=eval_3.Point, Motion=amp_3)  # -> Geometry, Transform
intcrv = Interpolate(Vertices=move_11.Geometry, Degree=3, Periodic=True, KnotStyle=1)  # -> Curve, Length, Domain

series_5 = Series(Start=0, Step=1, Count=number_slider_19)
rotate_4 = Rotate(Geometry=eval_3.Tangent, Angle=1.570796327, Plane=PlaneXY(0, 0, 0))  # -> Geometry, Transform
graph_3 = GraphMapper(series_5, x0=0, x1=1, y0=0, y1=1, container_name="Sine", Equation_px=[0, 0.2355532497], Equation_py=[0, 1])
vdis_4 = VectorDisplay(Anchor=eval_3.Point, Vector=rotate_4.Geometry)
amp_4 = Amplitude(Vector=rotate_4.Geometry, Amplitude=graph_3)
move_12 = Move(Geometry=eval_3.Point, Motion=amp_4)  # -> Geometry, Transform
intcrv_2 = Interpolate(Vertices=move_12.Geometry, Degree=3, Periodic=True, KnotStyle=1)  # -> Curve, Length, Domain

previewlw_3 = CustomPreviewLineweights(
    Geometry=move_9.Geometry,
    Shader=ColourSwatch(SwatchColor=RGB(255, 255, 255)),
    Thickness=Slider(6.3, range=0..10),
    Absolute=False)
# Roof (All Pavilions)
number_slider_20 = Slider(1, range=0..1)
meshpatch = MeshPatch(OuterBoundary=move_9.Geometry, AngleTolerance=0.1, Trimback=False, Divisions=1)
triremesh_2 = TriRemesh(Geometry=meshpatch, Length=number_slider_20, Iterations=25)  # -> Triangulation, Dual, Creases
medges_4 = MeshEdges(Mesh=triremesh_2.Triangulation)  # -> NakedEdges, InteriorEdges, NonManifoldEdges; disabled

# ---- group: Anchors
pt_6 = Point([<point referenced from the Rhino model> x7])

# ----
triremesh_3 = TriRemesh(Geometry=mesh_2, Iterations=25)  # -> Triangulation, Dual, Creases
# Terrain
medges_5 = MeshEdges(Mesh=triremesh_3.Triangulation)  # -> NakedEdges, InteriorEdges, NonManifoldEdges
dom_2 = ConstructDomain(DomainStart=Slider(0.52, range=0..1), DomainEnd=Slider(0.67, range=0..1))
dom_3 = ConstructDomain(DomainStart=Slider(0.46, range=0..1), DomainEnd=Slider(0.57, range=0..1))
dom² = ConstructDomain²(DomainU=dom_2, DomainV=dom_3)

item_9 = ListItem(List=triremesh_3.Triangulation, Index="1", Wrap=True)
Z_13 = UnitZ(Factor=1)
move_13 = Move(Geometry=item_9, Motion=Z_13)  # -> Geometry, Transform
medges_6 = MeshEdges(Mesh=move_13.Geometry)  # -> NakedEdges, InteriorEdges, NonManifoldEdges
previewlw_4 = CustomPreviewLineweights(
    Geometry=medges_6.NakedEdges,
    Shader=ColourSwatch(SwatchColor=RGB(0, 0, 0)),
    Thickness=Slider(2, range=0..100),
    Absolute=False)

contour_2 = Contour(Shape=item_9, Point=Point(0, 0, 0), Direction=Vector(0, 0, 1), Distance=Slider(1, range=0..50))
patch_2 = Patch(Curves=flatten(contour_2), Spans=20, Flexibility=1, Trim=True)

preview_10 = CustomPreview(Geometry=item_9, Material=ColourSwatch(SwatchColor=RGB(194, 194, 194)))  # disabled
subsrf = Isotrim(Surface=patch_2, Domain=dom²)

debrep_3 = DeconstructBrep(Brep=subsrf)  # -> Faces, Edges, Vertices
contour_3 = Contour(Shape=subsrf, Point=Point(0, 0, 0), Direction=Vector(0, 0, 1), Distance=Slider(1, range=0..50))
join_3 = JoinCurves(Curves=debrep_3.Edges, Preserve=False)
offsrf_2 = OffsetSurface(Surface=subsrf, Distance=Slider(-25, range=-100..0), BothSides=0, CreateSolid=True)  # disabled

# ---- group: Patch - Terrain
item_10 = ListItem(List=projecta_2.Geometry, Index=0, Wrap=True)  # -> Item1, Item
plfit_2 = PlaneFit(Points=debrep_3.Vertices)  # -> Plane, Deviation
offset_6 = OffsetCurve(Curve=join_3, Distance=Slider(5, range=-5..5), Plane=plfit_2.Plane, Corners=1)  # -> flatten(Curve)
merge_4 = Merge(Data1=geo_3, Data2=join_3, Data3=offset_6)  # -> flatten(Result)
patch_3 = Patch(Curves=merge_4, Spans=20, Flexibility=Slider(5, range=1..5), Trim=True)
project_7 = Project(Curve=crv_5, Brep=patch_3, Direction=Vector(0, 0, 1))
srfsplit_2 = SurfaceSplit(Surface=patch_3, Curves=project_7)
item_11 = ListItem(List=srfsplit_2, Index=0, Wrap=True)
contour_4 = Contour(Shape=item_11, Point=Point(0, 0, 0), Direction=Vector(0, 0, 1), Distance="0.5")
preview_11 = CustomPreview(Geometry=item_11, Material=ColourSwatch(SwatchColor=RGB(184, 184, 184)))

# ----
brep_9 = Brep(offsrf_2)
sdiff = SolidDifference(BrepsA=brep_9, BrepsB=sunion)
preview_12 = CustomPreview(Geometry=sdiff, Material=ColourSwatch(SwatchColor=RGB(255, 255, 255)))  # disabled

# ----
# Points and Obsticles
sunion_2 = SolidUnion(Breps=flatten(item_2))
xy_3 = XYPlane(Origin=pt)
sec = BrepPlane(Brep=sunion_2, Plane=xy_3)  # -> Curves, Points
number_slider_21 = Slider(1, range=0..300)

# ---- group: View Lines
project_8 = Project(Geometry=pt, Plane=PlaneXY(0, 0, 0))  # -> Geometry, Transform
ivist = IsoVist(Plane=pt, Count=Slider(24, range=0..300), Radius=Slider(13.5, range=0.1..30), Obstacles=flatten(sec.Curves))  # -> Points, Distance, Index
pline_2 = PolyLine(Vertices=ivist.Points, Closed=True)
simplify = SimplifyCurve(Curve=pline_2, Tolerance=Slider(0.5, range=0..10), AngleTolerance=Slider(25, range=0..100))  # -> Curve, Simplified
explode = Explode(Curve=simplify.Curve, Recursive=True)  # -> Segments, Vertices
curvepoint = PointOnCurve(explode.Segments, parameter=0.498)

# ----
boundary_5 = BoundarySurfaces(Edges=pline_2)
ln = Line(StartPoint=graft(pt), EndPoint=curvepoint)
previewlw_5 = CustomPreviewLineweights(Geometry=pline_2, Shader=ColourSwatch(SwatchColor=RGB(186, 0, 0)), Thickness=Slider(11, range=0..100), Absolute=False)
preview_13 = CustomPreview(Geometry=boundary_5, Material=ColourSwatch(SwatchColor=RGB(150, 92, 92)))  # disabled

disc_6 = Discontinuity(Curve=crv, Level=1)  # -> Points, Parameters
# Kangaroo (One Cell)
toggle_6 = GroupToggle(ToggleActive=True, ToggleVisible=False)  # disabled
avr_2 = Average(Input=disc_6.Points)
ln_2 = Line(StartPoint=disc_6.Points, EndPoint=avr_2)
number_slider_22 = Slider(0, range=0..2)
ext = ExtendCurve(Curve=ln_2, Type=number_slider_22, Start=number_slider_22, End=Slider(-0.4, range=-1..0))
shift_4 = ShiftList(List=ext, Shift=1, Wrap=True)
rulesrf = RuledSurface(CurveA=shift_4, CurveB=ext)
mesh_uv = MeshSurface(Surface=rulesrf, UCount=Slider(15, range=1..30), VCount=Slider(3, range=1..30), Overhang=True, Equalize=False)
mjoin = MeshJoin(Meshes=mesh_uv)
weldvertices = MeshWeldVertices(Mesh=mjoin, Tolerance=0.01)  # -> RuntimeMessage, Mesh
nv_2 = NakedVertices(Mesh=weldvertices.Mesh)  # -> ClothedIndex, NakedIndex, ClothedPts, NakedPts
medges_7 = MeshEdges(Mesh=weldvertices.Mesh)  # -> NakedEdges, InteriorEdges, NonManifoldEdges
demesh_2 = DeconstructMesh(Mesh=weldvertices.Mesh)  # -> Vertices, Faces, Colours, Normals
midpt = CurveMiddle(Curve=medges_7.NakedEdges)
avr_3 = Average(Input=midpt)
pull = PullPoint(Point=nv_2.NakedPts, Geometry=crv, ClosestOnly=True)  # -> ClosestPoint, Distance
dist = Distance(PointA=midpt, PointB=avr_3)
smaller = SmallerThan(FirstNumber=dist, SecondNumber=Slider(3.18, range=0..5))  # -> SmallerThan, OrEqualTo
smaller_2 = SmallerThan(FirstNumber=pull.Distance, SecondNumber=Slider(0.1, range=0.1..0.11))  # -> SmallerThan, OrEqualTo
cull_5 = CullPattern(List=medges_7.NakedEdges, CullPattern=smaller.SmallerThan)
len_3 = Length(Curve=medges_7.InteriorEdges)
cull_6 = CullPattern(List=nv_2.NakedPts, CullPattern=invert(smaller_2.SmallerThan))
cull_7 = CullPattern(List=nv_2.NakedPts, CullPattern=smaller_2.SmallerThan)
Z_14 = UnitZ(Factor=Slider(-3, range=-6..0))
len_4 = Length(Curve=cull_5)
move_14 = Move(Geometry=cull_6, Motion=Z_14)  # -> Geometry, Transform
vec_2 = VectorXYZ(XComponent=Slider(0, range=-10..10), YComponent=0, ZComponent=Slider(2.71, range=0..10))  # -> Vector, Length
anchor_2 = Anchor(Point=cull_7, Strength=10000)
anchor_3 = Anchor(Point=cull_6, Target=move_14.Geometry, Strength=10000)
load_2 = Load(Point=demesh_2.Vertices, ForceVector=vec_2.Vector, Weighting=1)
show_2 = Show(G=weldvertices.Mesh)

# ---- group: All other segments
multiplication_2 = Multiplication(A=len_3, B=Slider(0, range=0..1))
length_line_2 = LengthLine(Line=medges_7.InteriorEdges, Length=multiplication_2, Strength=Slider(30, range=0..100))

# ---- group: Central Ring
multiplication_3 = Multiplication(A=len_4, B=Slider(0, range=0..1))
length_line_3 = LengthLine(Line=cull_5, Length=multiplication_3, Strength=Slider(10000, range=0..10000))

# ----
entwine_3 = Entwine(
    Branch00=show_2,
    Branch01=length_line_2,
    Branch02=length_line_3,
    Branch03=load_2,
    Branch04=anchor_2,
    Branch05=anchor_3,
    FlattenInputs=True)
bouncysolver_2 = BouncySolver(GoalObjects=entwine_3, Reset=Button(), Threshold=1e-15, Tolerance=0.0001, Damping=0.99, Iterations=10, On=Toggle(False))  # -> I, V, O
item_12 = ListItem(List=bouncysolver_2.O, Index=0, Wrap=True)

medges_8 = MeshEdges(Mesh=item_12)  # -> NakedEdges, InteriorEdges, NonManifoldEdges
preview_14 = CustomPreview(Geometry=item_12, Material=ColourSwatch(SwatchColor=RGBA(255, 255, 255, 172)))
toggle_7 = GroupToggle(ToggleActive=True, ToggleVisible=False)  # disabled

previewlw_6 = CustomPreviewLineweights(Geometry=medges_8.InteriorEdges, Shader=ColourSwatch(SwatchColor=RGB(0, 0, 0)), Absolute=False)

# ----
# Roofs Attempts
boundary_6 = BoundarySurfaces(Edges=item_3.Item1)  # disabled
disc_7 = Discontinuity(Curve=item_3.Item1, Level=1)  # -> Points, Parameters; disabled
number_slider_23 = Slider(1, range=0..10)  # disabled
toggle_8 = GroupToggle(ToggleActive=True, ToggleVisible=False)  # disabled
mesh_6 = MeshBrep(
    Brep=boundary_6,
    Settings={GridMaxCount=0, GridMinCount=16, JaggedSeams=False, MaxEdgeLength=0, MinEdgeLength=0.0001, MinTolerance=0, Refine=True, RefineAngle=0, RelativeTolerance=0.65, SimplePlanes=True, Tolerance=0})  # disabled
triremesh_4 = TriRemesh(Geometry=mesh_6, Length=number_slider_23, Iterations=25)  # -> Triangulation, Dual, Creases; disabled
nv_3 = NakedVertices(Mesh=triremesh_4.Triangulation)  # -> ClothedIndex, NakedIndex, ClothedPts, NakedPts; disabled
medges_9 = MeshEdges(Mesh=triremesh_4.Triangulation)  # -> NakedEdges, InteriorEdges, NonManifoldEdges; disabled
demesh_3 = DeconstructMesh(Mesh=triremesh_4.Triangulation)  # -> Vertices, Faces, Colours, Normals; disabled
len_5 = Length(Curve=medges_9.InteriorEdges)  # disabled
number_slider_24 = Slider(0, range=-10..10)  # disabled
number_slider_25 = Slider(2.71, range=0..10)  # disabled
vec_3 = VectorXYZ(XComponent=number_slider_24, YComponent=0, ZComponent=number_slider_25)  # -> Vector, Length; disabled
anchor_4 = Anchor(Point=nv_3.NakedPts, Strength=10000)  # disabled
load_3 = Load(Point=demesh_3.Vertices, ForceVector=vec_3.Vector, Weighting=1)  # disabled
show_3 = Show(G=triremesh_4.Triangulation)  # disabled
toggle_9 = BooleanToggle(False)  # disabled
button_2 = Button()  # disabled

# ---- group: All other segments
number_slider_26 = Slider(0, range=0..1)  # disabled
number_slider_27 = Slider(18, range=0..100)  # disabled
multiplication_4 = Multiplication(A=len_5, B=number_slider_26)  # disabled
length_line_4 = LengthLine(Line=medges_9.InteriorEdges, Length=multiplication_4, Strength=number_slider_27)  # disabled

# ----
entwine_4 = Entwine(Branch00=show_3, Branch01=length_line_4, Branch02=load_3, Branch03=anchor_4, FlattenInputs=True)  # disabled
bouncysolver_3 = BouncySolver(GoalObjects=entwine_4, Reset=button_2, Threshold=1e-15, Tolerance=0.0001, Damping=0.99, Iterations=10, On=toggle_9)  # -> I, V, O; disabled
item_13 = ListItem(List=bouncysolver_3.O, Index=0, Wrap=True)  # disabled
medges_10 = MeshEdges(Mesh=item_13)  # -> NakedEdges, InteriorEdges, NonManifoldEdges; disabled

preview_15 = CustomPreview(Geometry=[item_7, item_13], Material=ColourSwatch(SwatchColor=RGB(255, 194, 194)))  # disabled

toggle_10 = GroupToggle(ToggleActive=True, ToggleVisible=False)  # disabled
boundary_7 = BoundarySurfaces(Edges=move_9.Geometry)
mesh_7 = MeshBrep(
    Brep=boundary_7,
    Settings={GridMaxCount=0, GridMinCount=16, JaggedSeams=False, MaxEdgeLength=0, MinEdgeLength=0.0001, MinTolerance=0, Refine=True, RefineAngle=0, RelativeTolerance=0.65, SimplePlanes=True, Tolerance=0})
triremesh_5 = TriRemesh(Geometry=mesh_7, Length=Slider(1, range=0..1), Iterations=25)  # -> Triangulation, Dual, Creases
genes = GenePool(Decimals=2, Maximum=10, Minimum=-15, Value=[-9.7, -7.85, -6.41, -4.86, -6.45, -6.53, -4.62])
number_slider_28 = Slider(-9.895, range=-20..10)
nv_4 = NakedVertices(Mesh=triremesh_2.Triangulation)  # -> ClothedIndex, NakedIndex, ClothedPts, NakedPts
Z_15 = UnitZ(Factor=genes)
vec_4 = VectorXYZ(XComponent=Slider(0, range=-10..10), YComponent=0, ZComponent=Slider(7.79, range=0..10))  # -> Vector, Length
edgelengths_2 = EdgeLengths(Mesh=triremesh_2.Triangulation, LengthFactor=Slider(0, range=0..1), Strength=Slider(14, range=0..100))
anchor_5 = Anchor(Point=nv_4.NakedPts, Strength=10000)
show_4 = Show(G=triremesh_2.Triangulation)
load_4 = Load(Point=nv_4.ClothedPts, ForceVector=vec_4.Vector, Weighting=1)

cp = ClosestPoint(Point=pt_6, Cloud=nv_4.ClothedPts)  # -> ClosestPoint, CPIndex, Distance

move_15 = Move(Geometry=cp.ClosestPoint, Motion=Z_15)  # -> Geometry, Transform
anchor_6 = Anchor(Point=cp.ClosestPoint, Target=move_15.Geometry, Strength=10000)
entwine_5 = Entwine(Branch00=show_4, Branch01=edgelengths_2, Branch02=load_4, Branch03=anchor_5, Branch04=anchor_6, FlattenInputs=True)
bouncysolver_4 = BouncySolver(GoalObjects=entwine_5, Reset=Button(), Threshold=1e-15, Tolerance=0.0001, Damping=0.99, Iterations=10, On=Toggle(True))  # -> I, V, O
item_14 = ListItem(List=bouncysolver_4.O, Index=0, Wrap=True)
medges_11 = MeshEdges(Mesh=item_14)  # -> NakedEdges, InteriorEdges, NonManifoldEdges

previewlw_7 = CustomPreviewLineweights(
    Geometry=medges_11.InteriorEdges,
    Shader=ColourSwatch(SwatchColor=RGB(0, 0, 0)),
    Thickness=Slider(0.03, range=0..1),
    Absolute=True)
preview_16 = CustomPreview(Geometry=item_14, Material=ColourSwatch(SwatchColor=RGB(117, 117, 117)))
